# Grasshopper definition CSV_vessel.gh (Grasshopper 1.0.7)

python = GhPythonScript()  # -> out, file
# ---------- python: Python ----------
import rhinoscriptsyntax as rs

filter = "CSV file (*.csv)|*.csv|*.txt|All Files (*.*)|*.*||"
file = rs.OpenFileName("Open Point File", filter)
# ---------- end python ----------
python_2 = GhPythonScript(file=python.file)  # -> out, line, axis
# ---------- python_2: Python ----------
import rhinoscriptsyntax as rs
import csv

def data_parse(file):
    data = []
    with open(file) as file:
        reader = csv.reader(file)
        i = 0
        for row in reader:
            birds = int(row[1])
            data_row = [i,birds]
            data.append(data_row)
            i+=10
    file.close()
    return data
def data_parse1(file):
    data = []
    with open(file) as file:
        reader = csv.reader(file)
        i = 0
        for row in reader:
            if(i>0):
                notes = float(row[1])
                data_row = [i-1,notes]
                data.append(data_row)
            i+=1
    file.close()
    return data
    

def plot(data):
    points= []
    for i in range(5,17):
        point = rs.CreatePoint(data[i][1]/5,0,data[i][0])
        points.append(point)
    line = rs.AddPolyline(points)
    curve = rs.AddCurve(points)
    return curve

data = data_parse(file)
#data = data_parse1(file)
line = plot(data)

axis = rs.AddLine(rs.CreatePoint(0,0,0),rs.CreatePoint(0,0,1))
# ---------- end python_2 ----------
offset = OffsetCurve(Curve=python_2.line, Distance=Slider(1, range=-2..10), Corners=1)
revsrf = Revolution(Curve=python_2.line, Axis=python_2.axis, Domain=Domain(0, 6.283185307))
revsrf_2 = Revolution(Curve=offset, Axis=python_2.axis, Domain=Domain(0, 6.283185307))
cap = CapHoles(Brep=revsrf)
cap_2 = CapHoles(Brep=revsrf_2)
sdiff = SolidDifference(BrepsA=cap, BrepsB=cap_2)
