# Grasshopper definition MichelRobertLA3.gh (Grasshopper 1.0.7)
# plug-ins: Human

python = GhPythonScript()  # -> out, file
# ---------- python: Python ----------
import rhinoscriptsyntax as rs

filter = "IMG file (*.bmp)|*.png|All Files (*.*)|*.*||"
file = rs.OpenFileName("Open Image File", filter)
# ---------- end python ----------
# Large Assignment 3: Data Physicalization
# Name: Michel Robert
# E-mail: mrobert12@unm.edu
# Course: CS491, Computational Fabrication
# Submitted 10/9/2023
# 
# This program generates 3D forms from data
# files. There are two different lines to run from.
# One reads CSV files and the other reads BMP
# files. The BMP portion creats a set of lines from
# pixel brightness and number of pixels in a row
#  that are connected with the loft and then it
# creates a base for the bitmap object.
# 
# The CSV portion has two different functions for
# the two objects. The first is for reading data I
# found from Audubon's christmas bird count. I
# copied the columns for year and for the number
# of birds observed creating a CSV with two columns.
# 
# The second is for reading MIDI note data. It
# also reads a two column CSV with note group
# numbers and the average of their MIDI note
# values.
python_2 = GhPythonScript()  # -> out, file
# ---------- python_2: Python ----------
import rhinoscriptsyntax as rs

filter = "CSV file (*.csv)|*.csv|*.txt|All Files (*.*)|*.*||"
file = rs.OpenFileName("Open Point File", filter)
# ---------- end python_2 ----------
bitmap = BitmapFromFile(BitmapPath=python.file)  # -> Bitmap, Width, Height
python_3 = GhPythonScript(file=python_2.file)  # -> out, line, axis
# ---------- python_3: Python ----------
import rhinoscriptsyntax as rs
import csv

def data_parse(file):
    data = []
    with open(file) as file:
        reader = csv.reader(file)
        i = 0
        for row in reader:
            birds = int(row[1])
            data_row = [i,birds]
            data.append(data_row)
            i+=10
    file.close()
    return data
def data_parse1(file):
    data = []
    with open(file) as file:
        reader = csv.reader(file)
        i = 0
        for row in reader:
            if(i>0):
                notes = float(row[1])
                data_row = [i-1,notes]
                data.append(data_row)
            i+=1
    file.close()
    return data
    

def plot(data):
    points= []
    for i in range(5,17):
        point = rs.CreatePoint(data[i][1]/5,0,data[i][0])
        points.append(point)
    line = rs.AddPolyline(points)
    curve = rs.AddCurve(points)
    return curve

data = data_parse(file)
#data = data_parse1(file)
line = plot(data)

axis = rs.AddLine(rs.CreatePoint(0,0,0),rs.CreatePoint(0,0,1))
# ---------- end python_3 ----------
python_4 = GhPythonScript(w=bitmap.Width, h=bitmap.Height)  # -> out, array1D, array2D
# ---------- python_4: Python ----------
import rhinoscriptsyntax as rs
    
array2D = []
array1D = []
def bitmap():

    for i in range(0,w,10):
        row = []
        for j in range (0,h,10):
            row.append(rs.CreatePoint(i,j,0))
            array1D.append(rs.CreatePoint(i/float(w),j/float(h),0))
        array2D.append(row)

    
data = bitmap()
# ---------- end python_4 ----------
samplebmp = SampleBitmap(Bitmap=bitmap.Bitmap, Coordinates=python_4.array1D)  # -> Colors, Values
python_5 = GhPythonScript(brightness=samplebmp.Values, array=python_4.array2D)  # -> out, lines; inputs brightness: list, array: list
# ---------- python_5: Python ----------
import rhinoscriptsyntax as rs

lines = []

b = 0
for i in range (0,len(array)):
    points = []
    for j in range (0,len(array[i])):
        point = rs.CreatePoint(array[i][j].X,array[i][j].Y,brightness[b]*200)
        points.append(point)
        b = b + 1
    line = rs.AddCurve(points)
    lines.append(line)
# ---------- end python_5 ----------
offset = OffsetCurve(Curve=python_3.line, Distance=Slider(1, range=-2..10), Corners=1)
revsrf = Revolution(Curve=python_3.line, Axis=python_3.axis, Domain=Domain(0, 6.283185307))
revsrf_2 = Revolution(Curve=offset, Axis=python_3.axis, Domain=Domain(0, 6.283185307))
loft = Loft(Curves=python_5.lines, Options={Adjust=False, Closed=False, LoftEnds=0, LoftSimp=0, LoftType=0, Rebuild=10, Refit=0.01})
cap = CapHoles(Brep=revsrf)
edges = BrepEdges(Brep=loft)  # -> Naked, Interior, NonManifold
cap_2 = CapHoles(Brep=revsrf_2)
python_6 = GhPythonScript(edges=edges.Naked)  # -> out, surfaces; inputs edges: list
# ---------- python_6: Python ----------
import rhinoscriptsyntax as rs

surfaces = []
for i in range(0,len(edges)):
    curves = []
    point0 = rs.CurveStartPoint(edges[i])
    point1 = rs.CurveEndPoint(edges[i])
    point2 = rs.CreatePoint(point1.X,point1.Y,-15)
    point3 = rs.CreatePoint(point0.X,point0.Y,-15)
    curves.append(edges[i])
    line0 = rs.AddLine(point1,point2)
    line1 = rs.AddLine(point2,point3)
    line2 = rs.AddLine(point3,point0)
    curves.append(line0)
    curves.append(line1)
    curves.append(line2)
    surface = rs.AddEdgeSrf(curves)
    surfaces.append(surface)
# ---------- end python_6 ----------
sdiff = SolidDifference(BrepsA=cap, BrepsB=cap_2)
merge = Merge(Data1=python_6.surfaces, Data2=loft)  # -> flatten(Result)
join = BrepJoin(Breps=merge)  # -> Breps, Closed
cap_3 = CapHoles(Brep=join.Breps)
