# Grasshopper definition turtletest.gh (Grasshopper 1.0.7)

python = GhPythonScript()  # -> out, file
# ---------- python: Python ----------
import rhinoscriptsyntax as rs


filter = "Gcode File (*.gcode)|*.gcode|All Files (*.*)|*.*||"
file = rs.SaveFileName("Save Gcode File",filter)
# ---------- end python ----------
python_2 = GhPythonScript(file=python.file)  # -> out, lines, turtle, print_bed
# ---------- python_2: Python ----------
import rhinoscriptsyntax as rs

import extruder_turtle 
from extruder_turtle import *

t = ExtruderTurtle()
t.setup(filename = file, printer = "eazao")

t.print_printer_information()

for i in range(0,3):
    t.forward(50)
    t.right(120)
    
turtle = t.draw_turtle()

print_bed = t.draw_print_bed()

lines = t.get_lines()

t.finish()
# ---------- end python_2 ----------
