# Grasshopper definition Circle.gh (Grasshopper 1.0.7)

python = GhPythonScript()  # -> out, file
# ---------- python: Python ----------
import rhinoscriptsyntax as rs

filter = "GCode (*.gcode)|*.gcode|All Files (*.*)|*.*||"
file = rs.SaveFileName("", filter)
# ---------- end python ----------
panel = Panel(python.out)
python_2 = GhPythonScript(file=python.file, sides=Slider(10, range=0..20), size=Slider(12, range=0..50), layers=Slider(36, range=0..500))  # -> out, lines, turtle, draw_bed; inputs sides: Int32, layers: Int32
# ---------- python_2: Python ----------
import rhinoscriptsyntax as rs
import random as r
import extruder_turtle
from extruder_turtle import *
import math

t = ExtruderTurtle()
forward = 1
t.setup(filename = file, printer = "ender")
extrude_rate = t.get_extrude_rate()
layer_height = t.get_layer_height()
radius = 40
circumference = 2 * math.pi * radius
arc_length = circumference * (120/360)
distance = 2*radius *math.sin(arc_length/(2*radius))
angle = 0
def draw_circle(circumference):
    for i in range (0,360):
        t.forward(circumference /360)
        t.right(1)
def move_around_circle(angle):
    for i in range (0,angle):
        t.forward(circumference/360)
        t.right(1)
        
t.forward(radius)
t.right(90)
for i in range(0,5):
    draw_circle(circumference)
    t.lift(layer_height)
for i in range(0,layers):
    if(i % 2 == 1):
        move_around_circle(angle)
        t.right(120)
        t.forward(distance)
        for j in range(0,2):
            t.left(120)
            t.forward(distance)
        t.right(120)
        move_around_circle(360 -angle)
        angle += 30
    else:
        draw_circle(circumference)
    t.lift(layer_height)
    



turtle = t.draw_turtle()
lines = t.get_lines()
t.finish()
# ---------- end python_2 ----------
