# Grasshopper definition EscherTile.gh (Grasshopper 1.0.7)

angle = Slider(91, range=0..180)
b_curve = Geometry(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)
a_curve = Geometry(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)
python = GhPythonScript(a=Slider(8, range=1..10), b=Slider(6, range=1..10), angle=angle, a_curve=a_curve, b_curve=b_curve)  # -> out, a, b, vectors, curves, lines; inputs a_curve: Curve, b_curve: Curve
# ---------- python: Python ----------
import rhinoscriptsyntax as rs
import math

a_length = a
b_length = b

point = rs.CreatePoint(0,0,0)
ax = a_length*math.cos(math.radians(angle))
ay = a_length*math.sin(math.radians(angle))
b = rs.AddLine(point,rs.CreatePoint(b_length,0,0))
a = rs.AddLine(point,rs.CreatePoint(ax,ay,0))



lines = []
vectors = []
lines.append(a)
lines.append(b)

curves = []
a_curve_length = rs.CurveEndPoint(a_curve).Y
a_scale = a_length/a_curve_length
a_curve = rs.ScaleObject(a_curve,point,rs.CreatePoint(a_scale,a_scale,1))
a_curve = rs.RotateObject(a_curve,point,angle-90)
b_curve_length = rs.CurveEndPoint(b_curve).X
b_scale = b_length/b_curve_length
b_curve = rs.ScaleObject(b_curve,point,rs.CreatePoint(b_scale,b_scale,1))

curves.append(a_curve)
curves.append(b_curve)

vectors.append(rs.CreatePoint(ax,ay,0))
vectors.append(rs.CreatePoint(b_length,0,0))
# ---------- end python ----------
python_2 = GhPythonScript(lines=python.curves, vectors=python.vectors, size=Slider(3, range=0..10))  # -> out, lattice, colors; inputs lines: list of Curve, vectors: list of Point3d, size: Int32
# ---------- python_2: Python ----------
import rhinoscriptsyntax as rs
import math
import copy

lattice = []

for i in range(size+1):
    row = []
    for j in range(size+1):
        new_lines = copy.deepcopy(lines)
        rs.MoveObject(new_lines, vectors[1]*j)
        rs.MoveObject(new_lines, vectors[0]*i)
        row.append(new_lines)
    lattice.append(row)
    
tiles = []
colors = []
for i in range(size):
    for j in range(size):
        edge0 = lattice[i][j][1] #bottom edge
        edge1 = lattice[i][j][0] #left side
        edge2 = lattice[i+1][j][1] #top 
        edge3 = lattice[i][j+1][0] #right side
        tile = rs.JoinCurves([edge0,edge1,edge2,edge3])
        tiles = tiles + tile
        if (i+j) % 2 != 0:
            colors.append("0,0,255")
        else:
            colors.append("0,0,0")
edge0 = lattice[0][0][1]
edge1 = lattice[0][0][0]
edge2 = lattice[0+1][0][1]
edge3 = lattice[0][0+1][0]
point0 = rs.CurveEndPoint(edge0)
base_tile = []

#lines.append(rs.AddLine(point0,rs.CreatePoint(0,0,0)))
#point1 = rs.CurveEndPoint(edge1)
#lines.append(rs.AddLine(rs.CreatePoint(0,0,0),point1))
#point2 = rs.CurveEndPoint(edge2)
#lines.append(rs.AddLine(point1,point2))
#point3 = rs.CurveEndPoint(edge3)
#lines.append(rs.AddLine(point2,point0))
#base_tile = rs.JoinCurves(lines)
base_tile.append(rs.AddLine(rs.CurveEndPoint(edge0),rs.CurveStartPoint(edge0)))
base_tile.append(rs.AddLine(rs.CurveStartPoint(edge1),rs.CurveEndPoint(edge1)))
base_tile.append(rs.AddLine(rs.CurveStartPoint(edge2),rs.CurveEndPoint(edge2)))
base_tile.append(rs.AddLine(rs.CurveEndPoint(edge3),rs.CurveStartPoint(edge3)))
lattice = tiles
# ---------- end python_2 ----------
panel = Panel(python_2.lattice)
boundary = BoundarySurfaces(Edges=python_2.lattice)
preview = CustomPreview(Geometry=boundary, Material=python_2.colors)
