# Grasshopper definition HexagonalTessellation.gh (Grasshopper 1.0.7)

size = Slider(1, range=0..10)
geo = Geometry(<curve referenced from the Rhino model>)
geo_2 = Geometry(<curve referenced from the Rhino model>)
geo_3 = Geometry(<curve referenced from the Rhino model>)
python = GhPythonScript(side_len=Slider(10, range=0..10), size=size, curve1=geo_3, curve2=geo_2, curve3=geo)  # -> out, tiles, colors, line; inputs size: Int32
# ---------- python: Python ----------
import rhinoscriptsyntax as rs
import math


def hexagon_vertex_points(center_point, side_length):
    hexagon = []
    angle = 0
    for i in range(6):
        x = center_point.X + side_length * math.cos(math.radians(angle))
        y = center_point.Y + side_length * math.sin(math.radians(angle))
        hexagon.append(rs.CreatePoint((x, y, center_point.Z)))
        angle += 60
    return hexagon


side_length = side_len
rows = size
columns = size
hexagons = []
tiles = []
colors = []
for i in range(rows):
    for j in range(columns):
        x_offset = j * (3 / 2 * side_length)  
        y_offset = i * (math.sqrt(3) * side_length)  
        if j % 2 != 0:
            y_offset +=(math.sqrt(3)/2*side_length)
        
        hex_center = rs.CreatePoint(x_offset, y_offset, 0)
        hexagon_pts = hexagon_vertex_points(hex_center, side_length)
        hexagon_pts.append(hexagon_pts[0])
        hexagon = rs.AddPolyline(hexagon_pts)
        tiles.append(hexagon)
        if (i + j) % 2 == 0:
            colors.append("0,0,0")
        else:
            colors.append("250,100,0")
# ---------- end python ----------
panel = Panel(python.tiles)
preview = CustomPreview(Geometry=python.tiles, Material=python.colors)
