# Grasshopper definition HexagonTile.gh (Grasshopper 1.0.7)

# ----
# This python block creates the hexagons
# and creates 3 points for the vectors for
# offsetting location of the next hexagon.
number_slider = Slider(10, range=0..10)
# Large Assignment 5: Tiling
# Name: Michel Robert
# E-mail: Mrobert12@unm.edu
# Course: CS491, Computational Fabrication
# Submitted: 11/20/2023
# 
# This grasshopper program creates a
# hexagonal tiling of the xy-plane
python = GhPythonScript(side_len=number_slider, size=Slider(2, range=0..10))  # -> out, lines, vectors; inputs size: Int32
# ---------- python: Python ----------
import rhinoscriptsyntax as rs
import math

def draw_hexagon(center_point):
    pts = []
    hexagon = []
    angle = 0
    for i in range(7):
        x = center_point.X + side_len * math.cos(math.radians(angle))
        y = center_point.Y + side_len * math.sin(math.radians(angle))
        pts.append(rs.CreatePoint((x, y, 0)))
        angle += 60
    for i in range(6):
        start_pt = pts[i]
        end_pt = pts[i+1]
        line = rs.AddLine(start_pt, end_pt)
        hexagon.append(line)
    return hexagon

lines = draw_hexagon(rs.CreatePoint(0,0,0))
x_offset = 3/2 * side_len
y_offset1 = math.sqrt(3) * side_len
y_offset2 = math.sqrt(3)/2 *side_len
vectors = []
vectors.append(rs.CreatePoint(x_offset,0,0))
vectors.append(rs.CreatePoint(0,y_offset1,0))
vectors.append(rs.CreatePoint(x_offset,y_offset2,0))
# ---------- end python ----------

# ----
# This python block creates the tiling and
# adds the colors to each hexagon. The
# vector beign passed in has 3 different
# points because each other hexagon in a row has to be offset
# by different amounts in Y
number_slider_2 = Slider(4, range=0..10)
python_2 = GhPythonScript(lines=python.lines, vectors=python.vectors, size=number_slider_2)  # -> out, lattice, colors; inputs lines: list of Curve, vectors: list of Point3d, size: Int32
# ---------- python_2: Python ----------
import rhinoscriptsyntax as rs
import math
import copy

lattice = []
for i in range(size):
    
    row = []
    for j in range(size):
        new_lines = copy.deepcopy(lines)
        if j % 2 != 0:
            rs.MoveObject(new_lines,[vectors[2].X*j,(vectors[2].Y + (vectors[1].Y * i)),0])
        else:
            rs.MoveObject(new_lines,[vectors[0].X*j,vectors[1].Y * i,0])
        row.append(new_lines)
    lattice.append(row)
tiles = []
colors = []
for i in range(size):
    for j in range(size):
        edge0 = lattice[i][j][0]
        edge1 = lattice[i][j][1]
        edge2 = lattice[i][j][2]
        edge3 = lattice[i][j][3]
        edge4 = lattice[i][j][4]
        edge5 = lattice[i][j][5]
        tile = rs.JoinCurves([edge0,edge1,edge2,edge3,edge4,edge5])
        tiles = tiles + tile
        if (i+j)% 2 == 0:
            colors.append("0,0,255")
        else:
            colors.append("0,0,0")
lattice = tiles
# ---------- end python_2 ----------

boundary = BoundarySurfaces(Edges=python_2.lattice)
preview = CustomPreview(Geometry=boundary, Material=python_2.colors)
panel = Panel(python_2.lattice)
