# Grasshopper definition Snail.gh (Grasshopper 1.0.7)

python = GhPythonScript()  # -> out, file
# ---------- python: Python ----------
import rhinoscriptsyntax as rs

filter = "GCode (*.gcode)|*.gcode|All Files (*.*)|*.*||"
file = rs.SaveFileName("", filter)
# ---------- end python ----------
panel = Panel(python.out)
python_2 = GhPythonScript(file=python.file, sides=Slider(12, range=0..20), size=Slider(12, range=0..50), layers=Slider(20, range=0..500))  # -> out, lines, turtle, draw_bed; inputs sides: Int32, layers: Int32
# ---------- python_2: Python ----------
import rhinoscriptsyntax as rs
import random as r
import extruder_turtle
from extruder_turtle import *
import math

t = ExtruderTurtle()
forward = 1
t.setup(filename = file, printer = "ender")
extrude_rate = t.get_extrude_rate()
layer_height = t.get_layer_height()
total_angle = 0
print(layer_height)
print(extrude_rate)
for i in range(0,layers):
    t.forward(layers)
    t.right(90)
    if(layers % 5 == 0):
        t.forward(forward)
        t.right(180-math.degrees(math.atan(layers/forward)))
        t.forward(math.sqrt(math.pow(forward,2)+math.pow(layers,2)))
        t.back(math.sqrt(math.pow(forward,2)+math.pow(layers,2)))
        t.left(180-math.degrees(math.atan(layers/forward)))
        t.forward(layers-forward)
        forward += 1
        
    else:
        t.forward(layers)
    t.right(180-45)
    t.penup()
    t.forward(math.sqrt(math.pow(layers,2)+math.pow(layers,2)))
    t.pendown()
    t.right(180-45)
    t.lift(layer_height)
    
    
    
    
        

turtle = t.draw_turtle()
lines = t.get_lines()
t.finish()
# ---------- end python_2 ----------
