# Grasshopper definition Testing image on the side.gh (Grasshopper 1.0.7)

cylinder = Geometry(<brep referenced from the Rhino model>)
python = GhPythonScript(shape=cylinder)  # -> out, a; inputs shape: GeometryBase
# ---------- python: Python ----------
import rhinoscriptsyntax as rs
import random
import math
import ExtruderTurtle
from extruder_turtle import *

bb = rs.BoundingBox(shape)

bottom = rs.CreatePoint(0,0,0)
top = rs.CreatePoint(0,0,bb[7].Z)

t = ExtruderTurtle()
t2 = ExtruderTurtle()
t2.setup(printer = "ender")
t.setup(printer = "ender")
layer_height = t.get_layer_height()

slices = rs.AddSrfContourCrvs(shape,(bottom,top),layer_height)
triangles = [[0]*24 for _ in range(24)]

for i in range(0,24):
    for j in range(0,24):
        if i % 2 == 0:
            if (j-1) % 4 == 0:
                triangles[i][j] = 1
        else:
            if(j+1) % 4 != 0:
                triangles[i][j]= 1
amplitude = 2.0
num_oscillations = 5
num_points = 100
for layer in range(len(slices)):
    points = rs.DivideCurve(slices[layer],num_points)
    for point in range(len(points)):
        t2.set_position_point(points[point])
        theta = 360/num_points*i
        delta = amplitude * math.sin(num_oscillations*math.radians(theta))
        t2.right(90)
        t2.forward(delta)
        x = t2.getX()
        y = t2.getY()
        z = t2.getZ()
        t2.back(delta)
        t2.left(90)
        t.set_position(x,y,z)
        


a = t.get_lines()
t.finish()
# ---------- end python ----------
