# Grasshopper definition circle testing.gh (Grasshopper 1.0.7)

python = GhPythonScript()  # -> out, file
# ---------- python: Python ----------
import rhinoscriptsyntax as rs

filter = "GCode (*.gcode)|*.gcode|All Files (*.*)|*.*||"
file = rs.SaveFileName("", filter)
# ---------- end python ----------
panel = Panel(python.out)
python_2 = GhPythonScript(file=python.file, sides=Slider(10, range=0..20), size=Slider(12, range=0..50), layers=Slider(1, range=0..500))  # -> out, lines, turtle, draw_bed; inputs sides: Int32, layers: Int32
# ---------- python_2: Python ----------
import rhinoscriptsyntax as rs
import random as r
import extruder_turtle
from extruder_turtle import *
import math

t = ExtruderTurtle()
forward = 1
t.setup(filename = file, printer = "ender")
extrude_rate = t.get_extrude_rate()
layer_height = t.get_layer_height()
inner_radius = 5
inner_circumference = 2 * math.pi * inner_radius
outer_radius = 15
outer_circumference = 2 * math.pi * outer_radius
outer_to_inner = outer_radius - inner_radius
middle_z = 0
ourter_z = 0
to_middle = 0
def draw_circle(circumference):
    for i in range (0,360):
        t.forward(circumference /360)
        t.right(1)

def outer_circle_variance(circumference):
    for i in range(1,361):
        if i % (30 + to_middle) == 0:
            t.right(90)
            distance = math.sqrt(math.pow(outer_to_inner,2)+math.pow(middle_z * layer_height,2))
            for j in range(0,outer_to_inner * 10):
                t.forward(1/10 * distance/10)
                t.lift(((middle_z-1) *layer_height) /(distance * 10))
            for j in range(0,outer_to_inner * 10):
                t.back(1/10 * distance/10)
                t.lift(-((middle_z-1) *layer_height) /(distance * 10))
            t.left(90)
        t.forward(circumference/360)
        t.right(1)

def middle_circle():
    for ii in range(0,5):
        draw_circle(inner_circumference)
        t.penup()
        t.lift(layer_height)
        t.pendown()
        if ii > 0:
            global middle_z
            middle_z = middle_z + 1
    

def outer_circle():
    for i in range (0,3):
        if(i == 0):
            outer_circle_variance(outer_circumference)
            global to_middle
            to_middle += 5
        else:
            draw_circle(outer_circumference)
        t.penup()
        t.lift(layer_height)
        t.pendown()
        


for i in range (0,layers):
    middle_circle()
    print(t.getZ())
    t.left(90)
    t.penup()
    t.forward(outer_radius - inner_radius)
    t.right(90)
    t.lift(-middle_z * layer_height)
    t.pendown()
    outer_circle()
    t.penup()
    t.lift((middle_z-3) * layer_height)
    print(t.getZ())
    t.right(90)
    t.forward(outer_to_inner)
    t.left(90)
    t.pendown()




turtle = t.draw_turtle()
lines = t.get_lines()
t.finish()
# ---------- end python_2 ----------
