# Grasshopper definition gradiant.gh (Grasshopper 1.0.7)

python = GhPythonScript()  # -> out, file
# ---------- python: Python ----------
import rhinoscriptsyntax as rs

filter = "GCode (*.gcode)|*.gcode|All Files (*.*)|*.*||"
file = rs.SaveFileName("", filter)
# ---------- end python ----------
python_2 = GhPythonScript(file=python.file)  # -> out, turtle, a; inputs shape: GeometryBase
# ---------- python_2: Python ----------
import rhinoscriptsyntax as rs
import random
import math
import ExtruderTurtle
from extruder_turtle import *



t = ExtruderTurtle()
t.setup(filename = file,printer = "ender")
layer_height = t.get_layer_height()
X = 10
h = 0.2
for i in range(0,10):
    for layers in range(30):
        v = layers/30
        for side in range(9):
            for x in range(-X,X+1):
                a = v*h/X
                t.forward_lift(1,-x*a)
            t.right(360/9)
    t.lift(layer_height)
turtle = t.draw_turtle()
a = t.get_lines()
t.finish()
# ---------- end python_2 ----------
