# Grasshopper definition halfCircles.gh (Grasshopper 1.0.7)

python = GhPythonScript()  # -> out, file
# ---------- python: Python ----------
import rhinoscriptsyntax as rs

filter = "GCode (*.gcode)|*.gcode|All Files (*.*)|*.*||"
file = rs.SaveFileName("", filter)
# ---------- end python ----------
panel = Panel(python.out)
python_2 = GhPythonScript(file=python.file, sides=Slider(10, range=0..20), size=Slider(12, range=0..50), layers=Slider(45, range=0..500))  # -> out, lines, turtle, draw_bed; inputs sides: Int32, layers: Int32
# ---------- python_2: Python ----------
import rhinoscriptsyntax as rs
import random as r
import extruder_turtle
from extruder_turtle import *


t = ExtruderTurtle()
forward = 1
t.setup(filename = file, printer = "ender")
extrude_rate = t.get_extrude_rate()
layer_height = t.get_layer_height()

def half_circle_right():
    rand = r.randint(1,10)
    for i in range (0,180):
        t.forward(0.2)
        if i % rand == 0:
            t.left(90)
            t.forward(2)
            t.back(2)
            t.right(90)
        t.right(1)

def half_circle_left():
    for i in range (0,180):
        t.forward(0.2)
        t.left(1)

for ii in range(0,layers):
    for i in range (0,4):
        half_circle_right()
        t.right(90)
        half_circle_left()
    t.lift(layer_height)



turtle = t.draw_turtle()
lines = t.get_lines()
t.finish()
# ---------- end python_2 ----------
