# Grasshopper definition imageOnCylinder.gh (Grasshopper 1.0.7)

cylinder = Geometry(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)
python = GhPythonScript(shape=cylinder)  # -> out, a; inputs shape: GeometryBase
# ---------- python: Python ----------
import rhinoscriptsyntax as rs
import random
import math
import ExtruderTurtle
from extruder_turtle import *

bb = rs.BoundingBox(shape)

bottom = rs.CreatePoint(0,0,0)
top = rs.CreatePoint(0,0,bb[7].Z)

t = ExtruderTurtle()
t2 = ExtruderTurtle()
t2.setup(printer = "ender")
t.setup(printer = "ender")
layer_height = t.get_layer_height()

slices = rs.AddSrfContourCrvs(shape,(bottom,top),layer_height)
triangles = [[0]*24 for _ in range(24)]

for i in range(0,24):
    for j in range(0,24):
        if i % 2 == 0:
            if (j-1) % 4 == 0:
                triangles[i][j] = 1
        else:
            if(j+1) % 4 != 0:
                triangles[i][j]= 1


       

a = t.get_lines()
t.finish()
# ---------- end python ----------
