# Grasshopper definition intro.gh (Grasshopper 1.0.7)

python = GhPythonScript()  # -> out, file
# ---------- python: Python ----------
import rhinoscriptsyntax as rs

filter = "GCode (*.gcode)|*.gcode|All Files (*.*)|*.*||"
file = rs.SaveFileName("", filter)
# ---------- end python ----------
panel = Panel(python.out)
python_2 = GhPythonScript(file=python.file, sides=Slider(10, range=0..20), size=Slider(12, range=0..50), layers=Slider(5, range=0..500))  # -> out, lines, turtle, draw_bed; inputs sides: Int32, layers: Int32
# ---------- python_2: Python ----------
import rhinoscriptsyntax as rs
import random as r
import extruder_turtle
from extruder_turtle import *
import math

t = ExtruderTurtle()
t.setup(filename = file, printer = "ender")
t2 = ExtruderTurtle()
t2.setup(filename = file, printer = "ender")
extrude_rate = t.get_extrude_rate()
layer_height = t.get_layer_height()

amplitude = 0.05
for i in range(layers):
    for j in range(1,361):
        t.forward(0.4)
        t.right(1)
        x = t.getX()
        y = t.getY()
        z = t.getZ()
        t2.set_position(x,y,z)
        theta = (120)
        delta = math.sqrt(math.fabs(amplitude * math.sin(4 * math.radians(theta))))
        t2.right(90)
        t2.forward(delta)
        x = t2.getX()
        y = t2.getY()
        z = t2.getZ()
        t2.back(delta)
        t2.left(90)

        
    amplitude += 0.05
    t.lift(layer_height)


turtle = t.draw_turtle()
lines = t2.get_lines()
t.finish()
# ---------- end python_2 ----------
