# Grasshopper definition lifted circles.gh (Grasshopper 1.0.7)

python = GhPythonScript()  # -> out, file
# ---------- python: Python ----------
import rhinoscriptsyntax as rs

filter = "GCode (*.gcode)|*.gcode|All Files (*.*)|*.*||"
file = rs.SaveFileName("", filter)
# ---------- end python ----------
python_2 = GhPythonScript(file=python.file)  # -> out, turtle, a; inputs shape: GeometryBase
# ---------- python_2: Python ----------
import rhinoscriptsyntax as rs
import random
import math
import ExtruderTurtle
from extruder_turtle import *



t = ExtruderTurtle()
t.setup(filename = file,printer = "ender")
layer_height = t.get_layer_height()

t.penup()
t.forward(17)
t.pendown()
t.right(90)
forward = 0.1
for k in range(0,20):
    for j in range (0,12):
        for i in range (0,180):
            t.forward(forward)
            t.right(1)
        t.left(150)
    t.right(180)
    t.penup()
    t.lift(5*layer_height)
    t.forward(1)
    t.right(180)
    forward-=0.005
    t.pendown()

turtle = t.draw_turtle()
a = t.get_lines()
t.finish()
# ---------- end python_2 ----------
