# Grasshopper definition turtleSlicer.gh (Grasshopper 1.0.7)

geo = Geometry(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)
cylinder = Geometry(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)
geo_2 = Geometry(<brep referenced from the Rhino model>)
python = GhPythonScript(shape=geo_2)  # -> out, a; inputs shape: GeometryBase
# ---------- python: Python ----------
import rhinoscriptsyntax as rs
import random
import math
import ExtruderTurtle
from extruder_turtle import *

bb = rs.BoundingBox(shape)

bottom = rs.CreatePoint(0,0,0)
top = rs.CreatePoint(0,0,bb[7].Z)

t = ExtruderTurtle()
t2 = ExtruderTurtle()
t2.setup(printer = "ender")
t.setup(printer = "ender")
layer_height = t.get_layer_height()

slices = rs.AddSrfContourCrvs(shape,(bottom,top),layer_height)

num_points = 100
amplitude = 1.0
num_oscillations = 20
# mod l for having normal layers and spiky layers
for l in range(len(slices)):
    points = rs.DivideCurve(slices[l],num_points)
    for i in range (len(points)):
        if l % 2 == 1:
            x = points[i].X
            y = points[i].Y
            z = points[i].Z
            t2.set_position(x,y,z)
            theta = (360 / num_points) * i
            delta = math.sqrt(math.fabs(amplitude * math.sin(num_oscillations * math.radians(theta))))
            t2.right(90)
            t2.forward(delta)
            x = t2.getX()
            y = t2.getY()
            z = t2.getZ()
            t2.back(delta)
            t2.left(90)
            #if(i % 2 == 0 and l % 5 == 0):
            #    t2.right(90)
            #    t2.forward(amplitude)
            #    x = t2.getX()
            #    y = t2.getY()
            #    z = t2.getZ()
            #    t2.back(amplitude)
            #    t2.left(90)
            #elif(i % 2 == 1 and l % 5 == 0):
            #    t2.left(90)
            #    t2.forward(amplitude)
            #    x = t2.getX()
            #    y = t2.getY()
            #    z = t2.getZ()
            #    t2.back(amplitude)
            #    t2.right(90)#
            t.set_position(x,y,z)
        else:
            t.set_position_point(points[i])
        
        #t.left(90)
        #for j in range(5):
        #    t.forward(1)
        #    t.right(144)
        #t.right(90)
       

a = t.get_lines()
t.finish()
# ---------- end python ----------
