# Grasshopper definition MichelRobertLA2.gh (Grasshopper 1.0.7)

angle = Slider(40, range=-180..180)
angle_2 = Slider(80, range=-180..180)
angle_3 = Slider(60, range=-180..180)
r = Slider(33.6, range=0.1..100)
z = Slider(60, range=0..100)
z_2 = Slider(75, range=0..100)
z_3 = Slider(90, range=0..100)
angle_4 = Slider(10, range=-180..180)
r_2 = Slider(25, range=0.1..100)
r_3 = Slider(8, range=0.1..100)
z_4 = Slider(100, range=0..100)
r_4 = Slider(17.1, range=0.1..100)
r_5 = Slider(27.3, range=0.1..100)
angle_5 = Slider(30, range=-180..180)
angle_6 = Slider(70, range=-180..180)
angle_7 = Slider(0, range=-180..180)
r_6 = Slider(19.1, range=0.1..100)
r_7 = Slider(13.2, range=0.1..100)
angle_8 = Slider(10, range=-180..180)
angle_9 = Slider(50, range=-180..180)
r_8 = Slider(5.1, range=0.1..100)
angle_10 = Slider(5, range=-180..180)
z_5 = Slider(0, range=0..100)
z_6 = Slider(15, range=0..100)
z_7 = Slider(30, range=0..100)
angle_11 = Slider(0, range=-180..180)
facets = Slider(24, range=3..30)
facets_2 = Slider(24, range=3..30)
facets_3 = Slider(24, range=3..30)
z_8 = Slider(45, range=0..100)
facets_4 = Slider(24, range=3..30)
s = Slider(2, range=0.1..100)
s_2 = Slider(10, range=0.1..100)
s_3 = Slider(10, range=0.1..100)
angle_12 = Slider(0, range=-180..180)
facets_5 = Slider(24, range=3..30)
facets_6 = Slider(24, range=3..30)
facets_7 = Slider(18, range=3..30)
facets_8 = Slider(24, range=3..30)
angle_13 = Slider(0, range=-180..180)
s_4 = Slider(10, range=0.1..100)
angle_14 = Slider(-10, range=-180..180)
angle_15 = Slider(0, range=-180..180)
s_5 = Slider(4, range=0.1..100)
s_6 = Slider(10, range=0.1..100)
s_7 = Slider(2, range=0.1..100)
angle_16 = Slider(0, range=-180..180)
s_8 = Slider(3, range=0.1..100)
angle_list = Merge(Data1=angle_8, Data2=angle_4, Data3=angle_5, Data4=angle, Data5=angle_9, Data6=angle_3, Data7=angle_6, Data8=angle_2)  # -> reverse(Result)
pitch_list = Merge(
    Data1=angle_11,
    Data2=angle_7,
    Data3=angle_10,
    Data4=angle_14,
    Data5=angle_15,
    Data6=angle_12,
    Data7=angle_13,
    Data8=angle_16)  # -> reverse(Result)
s_list = Merge(Data1=s_2, Data2=s, Data3=s_3, Data4=s_5, Data5=s_6, Data6=s_4, Data7=s_7, Data8=s_8)
merge = Merge(
    Data1=facets_7,
    Data2=facets_8,
    Data3=facets_5,
    Data4=facets,
    Data5=facets_6,
    Data6=facets_4,
    Data7=facets_2,
    Data8=facets_3)
r_list = Merge(Data1=r_2, Data2=r, Data3=r_3, Data4=r_4, Data5=r_6, Data6=r_5, Data7=r_7, Data8=r_8)
z_list = Merge(Data1=z_5, Data2=z_6, Data3=z_7, Data4=z_8, Data5=z, Data6=z_2, Data7=z_3, Data8=z_4)
angle_17 = Slider(0, range=-180..180)
angle_18 = Slider(0, range=-180..180)
angle_19 = Slider(0, range=-180..180)
angle_20 = Slider(0, range=-180..180)
angle_21 = Slider(0, range=-180..180)
python = GhPythonScript(facets=merge, r=r_list, z=z_list, s=s_list)  # -> out, a, polygon; inputs facets: Int32
# ---------- python: Python ----------
import rhinoscriptsyntax as rs
import math

def polygonPoints (facets,r,z):
    points = []
    
    for i in range(0,facets+1):
        angle = 360/facets
        x = r*math.cos(math.radians(angle*i))
        y = r*math.sin(math.radians(angle*i))
        point = rs.CreatePoint(x,y,z)
        points.append(point)
    return points

def starPoints(facets,z,s):
    starPoints = []
    for i in range(0,facets+1):
        angle = 360/facets
        if i % 2 == 0:
            r = 10 + s* math.cos(math.radians(angle))
        else:
            r = s* math.cos(math.radians(angle))
        x = r*math.cos(math.radians(angle*i))
        y = r*math.sin(math.radians(angle*i))
        point = rs.CreatePoint(x,y,z)
        starPoints.append(point)
    return starPoints

def cog(facets,z,s):
    starPoints = []
    for i in range(0,facets+1):
        angle = 360/facets
        if(i%4 == 0):
            r = s*math.cos(math.radians(2*angle))
        if(i%4 == 1):
            r =5 + s*math.cos(math.radians(2*angle))
        else:
            r = 10+ s*2*math.cos(math.radians(2*angle))
        x = r*math.cos(math.radians(angle*i))
        y = r*math.sin(math.radians(angle*i))
        point = rs.CreatePoint(x,y,z)
        starPoints.append(point)
    return starPoints
    
#points = polygonPoints(facets,r,z)
#polygon = rs.AddPolyline(points)
#points = starPoints(facets,z,s)
#polygon = rs.AddPolyline(points)
points = cog(facets,z,s)
polygon = rs.AddPolyline(points)
# ---------- end python ----------
angle_22 = Slider(0, range=-180..180)
angle_23 = Slider(0, range=-180..180)
angle_24 = Slider(0, range=-180..180)
panel = Panel(python.out)
roll_list = Merge(
    Data1=angle_19,
    Data2=angle_17,
    Data3=angle_18,
    Data4=angle_20,
    Data5=angle_23,
    Data6=angle_21,
    Data7=angle_22,
    Data8=angle_24)  # -> reverse(Result)
python_2 = GhPythonScript(curve=python.polygon, angle=angle_list, pitch=pitch_list, roll=roll_list)  # -> out, a; inputs curve: Curve
# ---------- python_2: Python ----------
import rhinoscriptsyntax as rs
import Rhino.Geometry as geom
import math

def twist(curve, angle, pitch,roll):
    angle = math.radians(angle)
    pitch = math.radians(pitch)
    twist = geom.Transform.RotationZYX(angle,pitch,roll)
    curve.Transform(twist)
    
twist(curve,angle,pitch,roll)
a = curve
# ---------- end python_2 ----------
loft = Loft(Curves=python_2.a, Options={Adjust=False, Closed=False, LoftEnds=0, LoftSimp=0, LoftType=0, Rebuild=10, Refit=0.01})
pt = Point(python.a)
offset = OffsetCurve(Curve=python_2.a, Distance=Slider(-2, range=-10..10), Corners=1)  # -> flatten(Curve)
loft_2 = Loft(Curves=offset, Options={Adjust=False, Closed=False, LoftEnds=0, LoftSimp=0, LoftType=0, Rebuild=10, Refit=0.01})
loft_3 = Loft(Curves=python.polygon, Options={Adjust=False, Closed=False, LoftEnds=0, LoftSimp=0, LoftType=0, Rebuild=10, Refit=0.01})
cap = CapHoles(Brep=loft)
item = ListItem(List=python_2.a, Index=Slider(0, range=0..2), Wrap=True)
cap_2 = CapHoles(Brep=loft_2)
vec = VectorXYZ(XComponent=0, YComponent=0, ZComponent=Slider(-2, range=-10..10))  # -> Vector, Length
cap_3 = CapHoles(Brep=loft_3)
extr = Extrude(Base=item, Direction=vec.Vector)
sdiff = SolidDifference(BrepsA=cap, BrepsB=cap_2)
cap_4 = CapHoles(Brep=extr)
merge_2 = Merge(Data1=sdiff, Data2=cap_4)
# Large Assignment 2: Parametric Vessels
# Name: Michel Robert
# E-mail: Mrobert12@unm.edu
# Course: CS491, Computational Fabrication
# Submitted: 9/25/2024
# 
# This program creates a family of vessels.
# It creates lists for number of fascets radius
#  and the z values (height) and using the
# python function draws the curves of the
# polygon. The polygons can then be
# rotated around the z plane or the y plane. it
# creates a cap for the bottom of the object
# and a thickness for the walls.
# There are 3 functions in the first python
# block. The first makes vessels with basic
# polygons. The second makes vessels
# with star shapes. Third can make a cog
# shape with the right inputs but it is a bit
# picky with the number of fascets.
sunion = SolidUnion(Breps=merge_2)
