# Grasshopper definition 3dHexagonTIle.gh (Grasshopper 1.0.7)

# ----
# This is a python block for making the
# shape at the top of the tile. It is from my
# vessel program that creates a cog.  The
# number of facets can be changed making
# different shapes on top. The height and the
#  radius of the shape canalso be changed.
facets = Slider(24, range=0..32)
z = Slider(9, range=0..10)
s = Slider(1.1, range=0..10)
python = GhPythonScript(facets=facets, z=z, s=s)  # -> out, cog; inputs facets: Int32
# ---------- python: Python ----------
import rhinoscriptsyntax as rs
import math


def cog(facets,z,s):
    starPoints = []
    for i in range(0,facets+1):
        angle = 360/facets
        if(i%4 == 0):
            r = s*math.cos(math.radians(2*angle))
        if(i%4 == 1):
            r =2 + s*math.cos(math.radians(2*angle))
        else:
            r = 4+ s*math.cos(math.radians(2*angle))
        x = r*math.cos(math.radians(angle*i))
        y = r*math.sin(math.radians(angle*i))
        point = rs.CreatePoint(x,y,z)
        starPoints.append(point)
    return starPoints

cog = rs.AddPolyline(cog(facets,z,s))
# ---------- end python ----------

# ----
# This group is 3 hexagons at different
# heights. Each hexagon consists of 2
# python blocks. the firs python block
# creates the hexagon by creating
# points at the vertices and then creating
# a line using two of the points it also creates
#  vector points for relocating hexagons on
# the plane they're on. The second Python
#  block is for creating the tiling which is only
# useful for 2d tiling.
number_slider = Slider(6, range=0..10)
python_2 = GhPythonScript(side_len=Slider(9, range=0..20))  # -> out, lines, vectors
# ---------- python_2: Python ----------
import rhinoscriptsyntax as rs
import math

def draw_hexagon(center_point):
    pts = []
    hexagon = []
    angle = 0
    for i in range(7):
        x = center_point.X + side_len * math.cos(math.radians(angle))
        y = center_point.Y + side_len * math.sin(math.radians(angle))
        pts.append(rs.CreatePoint((x, y, 0)))
        angle += 60
    for i in range(6):
        start_pt = pts[i]
        end_pt = pts[i+1]
        line = rs.AddLine(start_pt, end_pt)
        hexagon.append(line)
    return hexagon

lines = draw_hexagon(rs.CreatePoint(0,0,0))
x_offset = 3/2 * side_len
y_offset1 = math.sqrt(3) * side_len
y_offset2 = math.sqrt(3)/2 *side_len
vectors = []
vectors.append(rs.CreatePoint(x_offset,0,0))
vectors.append(rs.CreatePoint(0,y_offset1,0))
vectors.append(rs.CreatePoint(x_offset,y_offset2,0))
# ---------- end python_2 ----------
python_3 = GhPythonScript(side_len=Slider(6, range=0..20), z=number_slider)  # -> out, lines, vectors
# ---------- python_3: Python ----------
import rhinoscriptsyntax as rs
import math

def draw_hexagon(center_point):
    pts = []
    hexagon = []
    angle = 0
    for i in range(7):
        x = center_point.X + side_len * math.cos(math.radians(angle))
        y = center_point.Y + side_len * math.sin(math.radians(angle))
        pts.append(rs.CreatePoint((x, y, center_point.Z)))
        angle += 60
    for i in range(6):
        start_pt = pts[i]
        end_pt = pts[i+1]
        line = rs.AddLine(start_pt, end_pt)
        hexagon.append(line)
    return hexagon

lines = draw_hexagon(rs.CreatePoint(0,0,z))
x_offset = 3/2 * side_len
y_offset1 = math.sqrt(3) * side_len
y_offset2 = math.sqrt(3)/2 *side_len
vectors = []
vectors.append(rs.CreatePoint(x_offset,0,0))
vectors.append(rs.CreatePoint(0,y_offset1,0))
vectors.append(rs.CreatePoint(x_offset,y_offset2,0))
# ---------- end python_3 ----------
python_4 = GhPythonScript(side_len=Slider(8, range=0..20), z=Slider(3, range=0..10))  # -> out, lines, vectors; same code as python_3
python_5 = GhPythonScript(lines=python_3.lines, vectors=python_3.vectors, size=Slider(1, range=0..10))  # -> out, lattice, colors; inputs lines: list of Curve, vectors: list of Point3d, size: Int32
# ---------- python_5: Python ----------
import rhinoscriptsyntax as rs
import math
import copy

lattice = []
for i in range(size):
    
    row = []
    for j in range(size):
        new_lines = copy.deepcopy(lines)
        if j % 2 != 0:
            rs.MoveObject(new_lines,[vectors[2].X*j,(vectors[2].Y + (vectors[1].Y * i)),0])
        else:
            rs.MoveObject(new_lines,[vectors[0].X*j,vectors[1].Y * i,0])
        row.append(new_lines)
    lattice.append(row)
tiles = []
colors = []
for i in range(size):
    for j in range(size):
        edge0 = lattice[i][j][0]
        edge1 = lattice[i][j][1]
        edge2 = lattice[i][j][2]
        edge3 = lattice[i][j][3]
        edge4 = lattice[i][j][4]
        edge5 = lattice[i][j][5]
        tile = rs.JoinCurves([edge0,edge1,edge2,edge3,edge4,edge5])
        tiles = tiles + tile
        if (i+j)% 2 == 0:
            colors.append("0,0,255")
        else:
            colors.append("0,0,0")
lattice = tiles
# ---------- end python_5 ----------
python_6 = GhPythonScript(lines=python_2.lines, vectors=python_2.vectors, size=Slider(1, range=0..10))  # -> out, lattice, colors; inputs lines: list of Curve, vectors: list of Point3d, size: Int32; same code as python_5
python_7 = GhPythonScript(lines=python_4.lines, vectors=python_4.vectors, size=Slider(1, range=0..10))  # -> out, lattice, colors; inputs lines: list of Curve, vectors: list of Point3d, size: Int32; same code as python_5

# ----
# This Group is to make the walls a bit
# thicker and join all the shapes to create a
# 3d tile
number_slider_2 = Slider(-1, range=-2..1)
merge = Merge(Data1=python.cog, Data2=python_5.lattice, Data3=python_7.lattice, Data4=python_6.lattice)  # -> flatten(Result)
offset = OffsetCurve(Curve=merge, Distance=number_slider_2, Corners=1)  # -> flatten(Curve)
loft = Loft(Curves=merge, Options={Adjust=False, Closed=False, LoftEnds=0, LoftSimp=0, LoftType=0, Rebuild=10, Refit=0.01})
loft_2 = Loft(Curves=offset, Options={Adjust=False, Closed=False, LoftEnds=0, LoftSimp=0, LoftType=0, Rebuild=10, Refit=0.01})
cap = CapHoles(Brep=loft)
cap_2 = CapHoles(Brep=loft_2)
sdiff = SolidDifference(BrepsA=cap, BrepsB=cap_2)

# ----
# Large Assignment 5: Tiling
# Name: Michel Robert
# E-mail: Mrobert12@unm.edu
# Course: CS491, Computational Fabrication
# Submitted: 11/21/2023
# 
# This program is for creating 3d tiles. it
# works by creating 3 hexagons at different z
# values and of variable side length. and
# topped with a cog like shape at the top of
# the tile the number of points on the cog can
# be changed to make more interesting tiling
panel = Panel(python_6.lattice)
boundary = BoundarySurfaces(Edges=python_6.lattice)
