# Grasshopper definition SurfaceTiling.gh (Grasshopper 1.0.7)

# ----
# This group makes Escher like tiles from a
# hexaon curve given 3 curves It creates
# points at the vertices of the hexagon and
# uses the points to place the curves given
# to the block after scaling and rotating them
# as necessary the first curve must end on
# the y axis and the second 2 must end on
# the x axis. It creats copies of the 3 curves
# and places the curve and its copy on
# opposite edges of the hexagon. The
# second python block creates the tiling of
# the plane by relocating the center of a
# copy of the hexagon using the vector
# points given from the first block. The first
# block also creates a base tile for
# surfacemorphing.
number_slider = Slider(7, range=0..10)
geo = Geometry(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)
geo_2 = Geometry(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)
geo_3 = Geometry(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)
number_slider_2 = Slider(10, range=0..10)
python = GhPythonScript(side_len=number_slider, curve1=geo, curve2=geo_2, curve3=geo_3)  # -> out, basetile, curves, vectors
# ---------- python: Python ----------
import rhinoscriptsyntax as rs
import math
import copy
def draw_hexagon(center,curve1,curve2,curve3):
    pts = []
    hexagon = []
    angle = 0
    height = math.sqrt(3) /2 * side_len
    point = rs.CreatePoint(0,0,0)
    curve1_len = rs.CurveEndPoint(curve1).Y
    curve2_len = rs.CurveEndPoint(curve2).X
    curve3_len = rs.CurveEndPoint(curve3).X
    scale_1 = side_len/curve1_len
    scale_2 = side_len/curve2_len
    scale_3 = side_len/curve3_len
    curve1 = rs.ScaleObject(curve1,point,rs.CreatePoint(scale_1,scale_1,1))
    curve2 = rs.ScaleObject(curve2,point,rs.CreatePoint(scale_2,scale_2,1))
    curve3 = rs.ScaleObject(curve3,point,rs.CreatePoint(scale_3,scale_3,1))
    curve1 = rs.RotateObject(curve1,center,-30)
    curve3 = rs.RotateObject(curve3,center,120)
    curve4 = rs.CopyObject(curve1)
    curve5 = rs.CopyObject(curve2)
    curve6 = rs.CopyObject(curve3)
    for i in range(7):
        x = center.X + side_len * math.cos(math.radians(angle))
        y = center.Y + side_len * math.sin(math.radians(angle))
        pts.append(rs.CreatePoint((x, y, 0)))
        angle += 60
    for i in range(6):
        if i % 3 == 0:
            if i ==0:
                curve = rs.MoveObject(curve3,pts[0])
            else:
                curve = rs.MoveObject(curve6,pts[4])
        elif i % 3 == 1:
            if i == 1:
                curve = rs.MoveObject(curve2,pts[2])
            else:
                curve = rs.MoveObject(curve5,pts[4])
        elif i % 3 == 2:
            if i == 2:
                curve = rs.MoveObject(curve1,pts[3])
            else:
                curve = rs.MoveObject(curve4,pts[5])
        hexagon.append(curve)
    return hexagon
def hexagon(center):
    pts = []
    hexagon = []
    angle = 0
    height = math.sqrt(3) /2 * side_len
    for i in range(7):
        x = center.X + side_len * math.cos(math.radians(angle))
        y = center.Y + side_len * math.sin(math.radians(angle))
        pts.append(rs.CreatePoint((x, y, 0)))
        angle += 60
    for i in range(6):
        start_pt = pts[i]
        end_pt = pts[i+1]
        line = rs.AddLine(start_pt, end_pt)
        hexagon.append(line)
    return hexagon
curves = draw_hexagon(rs.CreatePoint(0,0,0),curve1,curve2,curve3)
basetile = hexagon(rs.CreatePoint(0,0,0))
x_offset = 3/2 * side_len
y_offset1 = math.sqrt(3) * side_len
y_offset2 = math.sqrt(3)/2 *side_len
vectors = []
vectors.append(rs.CreatePoint(x_offset,0,0))
vectors.append(rs.CreatePoint(0,y_offset1,0))
vectors.append(rs.CreatePoint(x_offset,y_offset2,0))
# ---------- end python ----------
python_2 = GhPythonScript(lines=python.curves, vectors=python.vectors, size=number_slider_2)  # -> out, lattice, colors, basetile; inputs lines: list of Curve, vectors: list of Point3d, size: Int32
# ---------- python_2: Python ----------
import rhinoscriptsyntax as rs
import math
import copy

lattice = []
for i in range(size):
    row = []
    for j in range(size):
        new_lines = copy.deepcopy(lines)
        if j % 2 != 0:
            rs.MoveObject(new_lines,[vectors[2].X*j,(vectors[2].Y + (vectors[1].Y * i)),0])
        else:
            rs.MoveObject(new_lines,[vectors[0].X*j,vectors[1].Y * i,0])
        row.append(new_lines)
    lattice.append(row)
tiles = []
colors = []
for i in range(size):
    for j in range(size):
        edge0 = lattice[i][j][0]
        edge1 = lattice[i][j][1]
        edge2 = lattice[i][j][2]
        edge3 = lattice[i][j][3]
        edge4 = lattice[i][j][4]
        edge5 = lattice[i][j][5]
        tile = rs.JoinCurves([edge0,edge1,edge2,edge3,edge4,edge5])
        tiles = tiles + tile
        if (i+j)% 4 == 0:
            colors.append("0,0,255")
        elif(i+j)%4 == 2:
            colors.append("122,0,122")
        elif(i+j)%4 == 3:
            colors.append("0,0,0")
        else:
            colors.append("0,255,255)")
lattice = tiles
# ---------- end python_2 ----------
# Large Assignment 5: Tiling
# Name: Michel Robert
# E-mail: Mrobert12@unm.edu
# Course: CS491, Computational Fabrication
# Submitted: 11/21/2023
# 
# This program creates hexagonal escher
# like tiles from 3 lines. It creates a surface
# morph of the tile onto a given surface.
panel = Panel(python_2.lattice)
boundary = BoundarySurfaces(Edges=python_2.lattice)

# ----
# This group creates a surface for
# surfacemorph. This is from the data
# visualization assignment. I internalized the
# line data from the file. to simplify.
revsrf = Revolution(Curve=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, Axis=Line((0, 0, 0), (0, 0, 1)), Domain=Domain(0, 6.283185307))

boundary_2 = BoundarySurfaces(Edges=python.basetile)

# ----
# This group creates the surface morph. It
# uses a base tile which is just a hexagon
# created in my python blocks, the escher
# tile also created from the python blocks,
# and a surface. It uses the surface morph
# block to translate the tile to the surface.
number_slider_3 = Slider(1, range=0..10)
vec = VectorXYZ(XComponent=0, YComponent=0, ZComponent=number_slider_3)  # -> Vector, Length
extr = Extrude(Base=boundary_2, Direction=vec.Vector)
extr_2 = Extrude(Base=boundary, Direction=vec.Vector)
division = Division(A=1, B=number_slider_2)
bbox = BoundingBox(Content=extr, Plane=PlaneXY(0, 0, 0))  # -> Box, Box_2
dam = DataDam(
    DataA=extr_2,
    DataB=bbox.Box,
    DataC=revsrf,
    DataD=division,
    DataE=Slider(1, range=0..1),
    BufferDelay=10000000,
    BufferMode=0)  # -> DataA, DataB, DataC, DataD, DataE
srfmorph = SurfaceMorph(
    Geometry=dam.DataA,
    Reference=dam.DataB,
    Surface=reparameterize(dam.DataC),
    UDomain=dam.DataD,
    VDomain=dam.DataD,
    WDomain=dam.DataE)
preview = CustomPreview(Geometry=srfmorph, Material=python_2.colors)
