# Grasshopper definition Uke-Neck.gh (Grasshopper 1.0.7)
# plug-ins: Pufferfish

# ----
# This group creates all the shapes for the
# the neck and lofts between them to create
# the neck the debrep gives the plane of the
# angled pegbox for each circle. The python
# block creates 2 rectangles at the base of
# the neck and 2 curves that create the
# fingerboard section of the neck. The
# headstock is created from 2 surfaces that
# are trapezoids. at the top of the neck
# before the headstock the a rectangle is
# created to loft between the curve at the top
# of the neck and the headstock itself. There
# is a weird connection that is happening at
# this point but it still works.
python = GhPythonScript()  # -> out, lines, lines2, arc, arc2, head1, head2, nut_bot, nut_top, connector
# ---------- python: Python ----------
import rhinoscriptsyntax as rs

lines = []
points = []
point1 = rs.CreatePoint(0,0,0)
point2 = rs.CreatePoint(41,0,0)
point3 = rs.CreatePoint(41,41,0)
point4 = rs.CreatePoint(0,41,0)

points.append(point1)
points.append(point2)
points.append(point3)
points.append(point4)
lines.append(rs.AddLine(point3,point4))
lines.append(rs.AddLine(point2,point3))
lines.append(rs.AddLine(point1,point4))
lines.append(rs.AddLine(point2,point1))
point1 = rs.CreatePoint(0,0,5)
point2 = rs.CreatePoint(41,0,5)
point3 = rs.CreatePoint(41,41,5)
point4 = rs.CreatePoint(0,41,5)

lines2 = []
lines2.append(rs.AddLine(point3,point4))
lines2.append(rs.AddLine(point2,point3))
lines2.append(rs.AddLine(point1,point4))
lines2.append(rs.AddLine(point2,point1))
lines2 = rs.JoinCurves(lines2)

point = rs.CreatePoint(0,0,15)
points.append(point)
point = rs.CreatePoint(41,0,15)
points.append(point)
arc = rs.AddArc3Pt(points[4],points[5],rs.CreatePoint(0,4,15))
line = rs.AddLine(points[4],points[5])
arc = rs.JoinCurves([line,arc])
lines = rs.JoinCurves(lines)

point = rs.CreatePoint(3.876,0,164)
points.append(point)
point = rs.CreatePoint(36.124,0,164)
points.append(point)
arc2 = rs.AddCurve([points[6],rs.CreatePoint(19,15,164),points[7]])
line1 = rs.AddLine(points[6],points[7])
arc2 = rs.JoinCurves([line1,arc2])

connector = []

connector.append(rs.AddLine(rs.CreatePoint(3.876,16,169),rs.CreatePoint(36.124,16,169)))
connector.append(rs.AddLine(rs.CreatePoint(36.124,0,169),rs.CreatePoint(36.124,16,169)))
connector.append(rs.AddLine(rs.CreatePoint(3.876,0,169),rs.CreatePoint(36.124,0,169)))
connector.append(rs.AddLine(rs.CreatePoint(3.876,0,169),rs.CreatePoint(3.876,16,169)))



connector = rs.JoinCurves(connector)
point = rs.CreatePoint(3.876,0,169)
points.append(point)
point = rs.CreatePoint(36.124,0,169)
points.append(point)
point = rs.CreatePoint(55,5,217)
points.append(point)
point = rs.CreatePoint(-15,5,217)
points.append(point)
point = rs.CreatePoint(3.876,16,169)
points.append(point)
point = rs.CreatePoint(36.124,16,169)
points.append(point)
point = rs.CreatePoint(55,20.5,217)
points.append(point)
point = rs.CreatePoint(-15,20.5,217)
points.append(point)

head1 = [rs.AddLine(points[8],points[9]),rs.AddLine(points[9],points[10]),
        rs.AddLine(points[10],points[11]),rs.AddLine(points[11],points[8])]
head2 = [rs.AddLine(points[12],points[13]),rs.AddLine(points[13],points[14]),
        rs.AddLine(points[14],points[15]),rs.AddLine(points[15],points[12])]
        
head1 = rs.JoinCurves(head1)
head2 = rs.JoinCurves(head2)

nut_points = []
nut_top = []
nut_bot =[]
point = rs.CreatePoint(3.876,0,164)
nut_points.append(point)
point = rs.CreatePoint(3.876,0,162)
nut_points.append(point)
point = rs.CreatePoint(3.876,-1.5,162)
nut_points.append(point)
point = rs.CreatePoint(3.876,-1.5,164)
nut_points.append(point)
point = rs.CreatePoint(36.124,0,164)
nut_points.append(point)
point = rs.CreatePoint(36.124,0,162)
nut_points.append(point)
point = rs.CreatePoint(36.124,-1.5,162)
nut_points.append(point)
point = rs.CreatePoint(36.124,-1.5,164)
nut_points.append(point)
line = rs.AddLine(nut_points[0],nut_points[1])
nut_bot.append(line)
line = rs.AddLine(nut_points[1],nut_points[2])
nut_bot.append(line)
line = rs.AddLine(nut_points[2],nut_points[3])
nut_bot.append(line)
line = rs.AddLine(nut_points[3],nut_points[0])
nut_bot.append(line)
line = rs.AddLine(nut_points[4],nut_points[5])
nut_top.append(line)
line = rs.AddLine(nut_points[5],nut_points[6])
nut_top.append(line)
line = rs.AddLine(nut_points[6],nut_points[7])
nut_top.append(line)
line = rs.AddLine(nut_points[7],nut_points[4])
nut_top.append(line)
# ---------- end python ----------
boundary = BoundarySurfaces(Edges=python.head1)
boundary_2 = BoundarySurfaces(Edges=python.nut_bot)
boundary_3 = BoundarySurfaces(Edges=python.nut_top)
merge = Merge(Data1=python.lines, Data2=python.lines2)
merge_2 = Merge(Data1=python.lines2, Data2=python.arc)  # -> flatten(Result)
boundary_4 = BoundarySurfaces(Edges=python.head2)
merge_3 = Merge(Data1=boundary_2, Data2=boundary_3)
merge_4 = Merge(Data1=python.connector, Data2=python.arc2)
loft = Loft(Curves=merge, Options={Adjust=False, Closed=False, LoftEnds=0, LoftSimp=0, LoftType=0, Rebuild=10, Refit=0.01})
loft_2 = Loft(Curves=merge_3, Options={Adjust=False, Closed=False, LoftEnds=0, LoftSimp=0, LoftType=0, Rebuild=10, Refit=0.01})
loft_3 = Loft(Curves=merge_4, Options={Adjust=False, Closed=False, LoftEnds=0, LoftSimp=0, LoftType=0, Rebuild=10, Refit=0.01})
merge_5 = Merge(Data1=python.arc, Data2=python.arc2)
debrep = DeconstructBrep(Brep=boundary)  # -> Faces, Edges, Vertices
loft_4 = Loft(Curves=merge_2, Options={Adjust=False, Closed=False, LoftEnds=0, LoftSimp=0, LoftType=0, Rebuild=10, Refit=0.01})
cap = CapHoles(Brep=loft)
loft_5 = Loft(Curves=merge_5, Options={Adjust=False, Closed=False, LoftEnds=0, LoftSimp=0, LoftType=0, Rebuild=10, Refit=0.01})
cap_2 = CapHoles(Brep=loft_3)
cap_3 = CapHoles(Brep=loft_2)
merge_6 = Merge(Data1=boundary, Data2=boundary_4)
cap_4 = CapHoles(Brep=loft_4)
cap_5 = CapHoles(Brep=loft_5)
loft_6 = Loft(Curves=merge_6, Options={Adjust=False, Closed=False, LoftEnds=0, LoftSimp=0, LoftType=0, Rebuild=10, Refit=0.01})
cap_6 = CapHoles(Brep=loft_6)

# ----
# This group subdivides the front and back
# surfaces of the pegbox giving poitns to
# place the circles for the tuners.
number_slider = Slider(5, range=0..10)
sdivide = DivideSurface(Surface=boundary, UCount=Slider(5, range=0..10), VCount=Slider(4, range=0..10))  # -> flatten(Points), Normals, Parameters
sdivide_2 = DivideSurface(Surface=boundary_4, UCount=number_slider, VCount=Slider(4, range=0..10))  # -> flatten(Points), Normals, Parameters

# ----
# This group creates the circles on the front
# and back of the headstock and moves
# them to points on the surfaces it lofts
# between the two circles caps them
# creating cylinders and then
# takes the solid difference from the peg
# box.
number_slider_2 = Slider(5, range=0..10)
debrep_2 = DeconstructBrep(Brep=boundary_4)  # -> Faces, Edges, Vertices
item = ListItem(List=sdivide.Points, Index=Slider(4, range=0..30), Wrap=True)
item_2 = ListItem(List=sdivide.Points, Index=Slider(8, range=0..10), Wrap=True)
item_3 = ListItem(List=sdivide.Points, Index=Slider(6, range=0..10), Wrap=True)
item_4 = ListItem(List=sdivide.Points, Index=Slider(18, range=0..30), Wrap=True)
item_5 = ListItem(List=sdivide.Points, Index=Slider(16, range=0..30), Wrap=True)
item_6 = ListItem(List=sdivide_2.Points, Index=Slider(4, range=0..30), Wrap=True)
item_7 = ListItem(List=sdivide_2.Points, Index=Slider(8, range=0..10), Wrap=True)
item_8 = ListItem(List=sdivide_2.Points, Index=Slider(6, range=0..10), Wrap=True)
item_9 = ListItem(List=sdivide_2.Points, Index=Slider(18, range=0..30), Wrap=True)
item_10 = ListItem(List=sdivide_2.Points, Index=Slider(16, range=0..30), Wrap=True)
cir = Circle(Plane=debrep.Faces, Radius=number_slider_2)
cir_2 = Circle(Plane=debrep.Faces, Radius=number_slider_2)
cir_3 = Circle(Plane=debrep.Faces, Radius=number_slider_2)
cir_4 = Circle(Plane=debrep.Faces, Radius=number_slider_2)
cir_5 = Circle(Plane=debrep_2.Faces, Radius=number_slider_2)
cir_6 = Circle(Plane=debrep_2.Faces, Radius=number_slider_2)
cir_7 = Circle(Plane=debrep_2.Faces, Radius=number_slider_2)
cir_8 = Circle(Plane=debrep_2.Faces, Radius=number_slider_2)
move2pt = MoveToPoint(Geometry=cir, PointA=item, PointB=item_2)  # -> Moved, Vector, Transform
move2pt_2 = MoveToPoint(Geometry=cir_3, PointA=item, PointB=item_3)  # -> Moved, Vector, Transform
move2pt_3 = MoveToPoint(Geometry=cir_4, PointA=item, PointB=item_4)  # -> Moved, Vector, Transform
move2pt_4 = MoveToPoint(Geometry=cir_2, PointA=item, PointB=item_5)  # -> Moved, Vector, Transform
move2pt_5 = MoveToPoint(Geometry=cir_5, PointA=item_6, PointB=item_7)  # -> Moved, Vector, Transform
move2pt_6 = MoveToPoint(Geometry=cir_7, PointA=item_6, PointB=item_8)  # -> Moved, Vector, Transform
move2pt_7 = MoveToPoint(Geometry=cir_8, PointA=item_6, PointB=item_9)  # -> Moved, Vector, Transform
move2pt_8 = MoveToPoint(Geometry=cir_6, PointA=item_6, PointB=item_10)  # -> Moved, Vector, Transform
boundary_5 = BoundarySurfaces(Edges=move2pt_2.Moved)
boundary_6 = BoundarySurfaces(Edges=move2pt_3.Moved)
boundary_7 = BoundarySurfaces(Edges=move2pt.Moved)
boundary_8 = BoundarySurfaces(Edges=move2pt_4.Moved)
boundary_9 = BoundarySurfaces(Edges=move2pt_6.Moved)
boundary_10 = BoundarySurfaces(Edges=move2pt_7.Moved)
boundary_11 = BoundarySurfaces(Edges=move2pt_5.Moved)
boundary_12 = BoundarySurfaces(Edges=move2pt_8.Moved)
merge_7 = Merge(Data1=boundary_11, Data2=boundary_7)
merge_8 = Merge(Data1=boundary_5, Data2=boundary_9)
merge_9 = Merge(Data1=boundary_6, Data2=boundary_10)
merge_10 = Merge(Data1=boundary_8, Data2=boundary_12)
loft_7 = Loft(Curves=merge_7, Options={Adjust=False, Closed=False, LoftEnds=0, LoftSimp=0, LoftType=0, Rebuild=10, Refit=0.01})
loft_8 = Loft(Curves=merge_8, Options={Adjust=False, Closed=False, LoftEnds=0, LoftSimp=0, LoftType=0, Rebuild=10, Refit=0.01})
loft_9 = Loft(Curves=merge_9, Options={Adjust=False, Closed=False, LoftEnds=0, LoftSimp=0, LoftType=0, Rebuild=10, Refit=0.01})
loft_10 = Loft(Curves=merge_10, Options={Adjust=False, Closed=False, LoftEnds=0, LoftSimp=0, LoftType=0, Rebuild=10, Refit=0.01})
cap_7 = CapHoles(Brep=loft_7)
cap_8 = CapHoles(Brep=loft_8)
cap_9 = CapHoles(Brep=loft_9)
cap_10 = CapHoles(Brep=loft_10)
merge_11 = Merge(Data1=cap_7, Data2=cap_8, Data3=cap_9, Data4=cap_10)
sdiff = SolidDifference(BrepsA=cap_6, BrepsB=merge_11)

panel = Panel(cap)

# ----
# Final Project: Ukulele
# Name: Michel Robert, Daniel  Morales-Garcia
# E-mail: Mrobert12@unm.edu, dmorales33@unm.edu
# Course: CS491, Computational Fabrication
# Submitted: 12/8/2023
# 
# This program creates the neck of the
# instrument. The shapes are created using
# a python block, except for the circles used
# to create the holes for the tuners. Each
# group describes their function.
# This group merges everything together
# into a single object for baking
merge_12 = Merge(Data1=cap_4, Data2=cap_5, Data4=cap_3, Data5=cap, Data6=cap_2, Data7=sdiff)  # -> flatten(Result)
sunion = SolidUnion(Breps=merge_12)
