# Grasshopper definition ukulele.gh (Grasshopper 1.0.7)

# ----
# This group creates the rectangle for the front middle of the instrument, this section
# including the top and bottom walls are to ensure there is a place to connect the
# neck of the instrument. The first python block creates the lines of the rectangle
# and the boundary block creates a 2d surface that is extruded and capped to
# create a closed brep. The height is the Y value of the instrument the width is Z value
# and length is the x value of the center rectangle. The second python block
# creates the circle that will be cut out of the front of the instrument it takes a radius and
# height and length as well as a scaling value from 0 - 1 that help determine the
# placement of the circle on the instrument. The diameter can be no larger than the
# length of this center rectangle plus 2 timesa_length from the other two inner curves
# created below.
number_slider = Slider(13, range=0..25)
number_slider_2 = Slider(100, range=0..100)
number_slider_3 = Slider(20, range=0..100)
number_slider_4 = Slider(20, range=0..100)
python = GhPythonScript(height=number_slider_2, width=number_slider_4, length=number_slider_3)  # -> out, lines, points
# ---------- python: Python ----------
import rhinoscriptsyntax as rs

points = []
lines = []
point1 = rs.CreatePoint(0,0,0)
point2 = rs.CreatePoint(length,0,0)
point3 = rs.CreatePoint(length,height,0)
point4 = rs.CreatePoint(0,height,0)
points.append(point1)
points.append(point2)
points.append(point3)
points.append(point4)
line1 = rs.AddLine(rs.CreatePoint(0,0,0),rs.CreatePoint(length,0,0))
line2 = rs.AddLine(rs.CreatePoint(0,height,0),rs.CreatePoint(length,height,0))
line3 = rs.AddLine(rs.CreatePoint(0,0,0),rs.CreatePoint(0,height,0))
line4 = rs.AddLine(rs.CreatePoint(length,height,0),rs.CreatePoint(length,0,0))

lines.append(line1)
lines.append(line2)
lines.append(line3)
lines.append(line4)
lines = rs.JoinCurves(lines)
# ---------- end python ----------
python_2 = GhPythonScript(radius=number_slider, height=number_slider_2, length=number_slider_3, y=Slider(0.7, range=0..1))  # -> out, circle
# ---------- python_2: Python ----------
import rhinoscriptsyntax as rs

center = rs.CreatePoint(length/2,height*y,0)
circle = rs.AddCircle(center,radius)
# ---------- end python_2 ----------
number_slider_5 = Slider(2, range=-10..10)
boundary = BoundarySurfaces(Edges=python.lines)
vec = VectorXYZ(XComponent=0, YComponent=0, ZComponent=Slider(2, range=-10..10))  # -> Vector, Length
vec_2 = VectorXYZ(XComponent=0, YComponent=0, ZComponent=number_slider_5)  # -> Vector, Length
extr = Extrude(Base=python_2.circle, Direction=vec.Vector)
extr_2 = Extrude(Base=boundary, Direction=vec_2.Vector)
cap = CapHoles(Brep=extr)
cap_2 = CapHoles(Brep=extr_2)

geo = Geometry(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)
geo_2 = Geometry(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)
geo_3 = Geometry(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)
geo_4 = Geometry(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)

# ----
# This group creates the top and bottom
# rectangular walls of the instrument. The
# python block creates the 4 points using the
# heigth width and length for both top and
# bottom. The lines are created from the
# points and joined and a surface is created
# using the boundary block and then the
# walls are offset and capped to create the
# solid breps.
python_3 = GhPythonScript(height=number_slider_2, width=number_slider_4, length=number_slider_3)  # -> out, lines_top, lines_bot
# ---------- python_3: Python ----------
import rhinoscriptsyntax as rs

points = []
lines_top = []

line1 = rs.AddLine(rs.CreatePoint(0,height,0),rs.CreatePoint(0,height,width))
lines_top.append(line1)

line2 = rs.AddLine(rs.CreatePoint(0,height,width),rs.CreatePoint(length,height,width))
lines_top.append(line2)

line3 = rs.AddLine(rs.CreatePoint(0,height,0),rs.CreatePoint(length,height,0))
line4 = rs.AddLine(rs.CreatePoint(length,height,width),rs.CreatePoint(length,height,0))
lines_top.append(line3)
lines_top.append(line4)

lines_top = rs.JoinCurves(lines_top)

lines_bot = []
line1 = rs.AddLine(rs.CreatePoint(0,0,0),rs.CreatePoint(0,0,width))
lines_bot.append(line1)

line2 = rs.AddLine(rs.CreatePoint(0,0,width),rs.CreatePoint(length,0,width))
lines_bot.append(line2)

line3 = rs.AddLine(rs.CreatePoint(length,0,width),rs.CreatePoint(length,0,0))
line4 = rs.AddLine(rs.CreatePoint(length,0,0),rs.CreatePoint(0,0,0))
lines_bot.append(line3)
lines_bot.append(line4)

lines_bot = rs.JoinCurves(lines_bot)
# ---------- end python_3 ----------
boundary_2 = BoundarySurfaces(Edges=python_3.lines_bot)
boundary_3 = BoundarySurfaces(Edges=python_3.lines_top)
number_slider_6 = Slider(-2, range=-10..10)
number_slider_7 = Slider(2, range=-10..10)
vec_3 = VectorXYZ(XComponent=0, YComponent=number_slider_7, ZComponent=0)  # -> Vector, Length
vec_4 = VectorXYZ(XComponent=0, YComponent=number_slider_6, ZComponent=0)  # -> Vector, Length
extr_3 = Extrude(Base=boundary_3, Direction=vec_3.Vector)
extr_4 = Extrude(Base=boundary_2, Direction=vec_4.Vector)
cap_3 = CapHoles(Brep=extr_3)
cap_4 = CapHoles(Brep=extr_4)

# ----
# This group creates the 4 inner side walls at
# the top and the bottom of the instrument.
# The python block takes a curve and a
# lengh to scale this curve to the desired
# length. it also takes the same width from
# the original rectangle creation so
# everything is the same.  It takes the 4
# corner points from the rectangle so it know
# where to start drawing the curve. and the
# offsets are so the walls can match up and
# also so the loft for the face of the instrument
# covers the whole length. The outputs are
# the top and bottom curves of each of the 4
# corners of the rectangle. A surface is
# created by lofting between the two curves
#  and then the curves are offset to create the
# closed breps.
number_slider_8 = Slider(7, range=0..100)
python_4 = GhPythonScript(
    a_length=number_slider_8,
    a_curve=geo_2,
    width=number_slider_4,
    rectangle_points=python.points,
    z=number_slider_5,
    offset1=number_slider_7,
    offset2=number_slider_6)  # -> out, t_l, b_l, t_r, b_r, end_points; inputs rectangle_points: list of Point3d
# ---------- python_4: Python ----------
import rhinoscriptsyntax as rs

t_l = []
b_l = []
t_r = []
b_r = []
end_points = []
top_left = rs.CopyObject(a_curve)
point = rs.CreatePoint(rectangle_points[3].X,rectangle_points[3].Y+offset1,rectangle_points[3].Z)
top_left = rs.MoveObject(top_left,point)
top_left = rs.RotateObject(top_left,point,180)
a_curve_length = rs.CurveEndPoint(a_curve).X
a_scale = a_length/a_curve_length
top_left_b = rs.ScaleObject(top_left,point,rs.CreatePoint(a_scale,a_scale,1))
top_left_t = rs.CopyObject(top_left_b)
point = rs.CreatePoint(0,0,width)
top_left_t = rs.MoveObject(top_left_t,point)
t_l.append(top_left_b)
t_l.append(top_left_t)
end_point = rs.CurveEndPoint(top_left_b)
end_points.append(end_point)
bot_left = rs.CopyObject(a_curve)
point = rs.CreatePoint(rectangle_points[0].X,rectangle_points[0].Y+offset2,rectangle_points[0].Z)
bot_left = rs.MoveObject(bot_left,point)
bot_left = rs.RotateObject(bot_left,point,180)
a_curve_length = rs.CurveEndPoint(a_curve).X
a_scale = a_length/a_curve_length
bot_left_b = rs.ScaleObject(bot_left,point,rs.CreatePoint(a_scale,a_scale,1))
bot_left_t = rs.CopyObject(bot_left_b)
point = rs.CreatePoint(0,0,width)
bot_left_t = rs.MoveObject(bot_left_t,point)
end_point = rs.CurveEndPoint(bot_left_b)
end_points.append(end_point)
b_l.append(bot_left_b)
b_l.append(bot_left_t)

top_right = rs.CopyObject(a_curve)
point = rs.CreatePoint(rectangle_points[2].X,rectangle_points[2].Y+offset1,rectangle_points[2].Z)
top_right = rs.MoveObject(top_right,point)
a_curve_length = rs.CurveEndPoint(a_curve).X
a_scale = a_length/a_curve_length
top_right_b = rs.ScaleObject(top_right,point,rs.CreatePoint(a_scale,a_scale,1))
top_right_t = rs.CopyObject(top_right_b)
point = rs.CreatePoint(0,0,width)
top_right_t = rs.MoveObject(top_right_t,point)
end_point = rs.CurveEndPoint(top_right_b)
end_points.append(end_point)
t_r.append(top_right_b)
t_r.append(top_right_t)

bot_right = rs.CopyObject(a_curve)
point = rs.CreatePoint(rectangle_points[1].X,rectangle_points[1].Y+offset2,rectangle_points[1].Z)
bot_right = rs.MoveObject(bot_right,point)
a_curve_length = rs.CurveEndPoint(a_curve).X
a_scale = a_length/a_curve_length
bot_right_b = rs.ScaleObject(bot_right,point,rs.CreatePoint(a_scale,a_scale,1))
bot_right_t = rs.CopyObject(bot_right_b)
point = rs.CreatePoint(0,0,width)
bot_right_t = rs.MoveObject(bot_right_t,point)
end_point = rs.CurveEndPoint(bot_right_b)
end_points.append(end_point)
b_r.append(bot_right_b)
b_r.append(bot_right_t)
# ---------- end python_4 ----------
number_slider_9 = Slider(2, range=-10..10)
number_slider_10 = Slider(-2, range=-10..10)
loft = Loft(Curves=python_4.b_l, Options={Adjust=False, Closed=False, LoftEnds=0, LoftSimp=0, LoftType=0, Rebuild=10, Refit=0.01})
loft_2 = Loft(Curves=python_4.t_r, Options={Adjust=False, Closed=False, LoftEnds=0, LoftSimp=0, LoftType=0, Rebuild=10, Refit=0.01})
loft_3 = Loft(Curves=python_4.t_l, Options={Adjust=False, Closed=False, LoftEnds=0, LoftSimp=0, LoftType=0, Rebuild=10, Refit=0.01})
loft_4 = Loft(Curves=python_4.b_r, Options={Adjust=False, Closed=False, LoftEnds=0, LoftSimp=0, LoftType=0, Rebuild=10, Refit=0.01})
item = ListItem(List=loft, Index=0, Wrap=True)
item_2 = ListItem(List=loft_2, Index=0, Wrap=True)
item_3 = ListItem(List=loft_3, Index=0, Wrap=True)
vec_5 = VectorXYZ(XComponent=0, YComponent=number_slider_9, ZComponent=0)  # -> Vector, Length
vec_6 = VectorXYZ(XComponent=0, YComponent=number_slider_9, ZComponent=0)  # -> Vector, Length
vec_7 = VectorXYZ(XComponent=0, YComponent=number_slider_10, ZComponent=0)  # -> Vector, Length
vec_8 = VectorXYZ(XComponent=0, YComponent=number_slider_10, ZComponent=0)  # -> Vector, Length
extr_5 = Extrude(Base=loft_4, Direction=vec_5.Vector)
extr_6 = Extrude(Base=item_2, Direction=vec_8.Vector)
extr_7 = Extrude(Base=item, Direction=vec_6.Vector)
extr_8 = Extrude(Base=item_3, Direction=vec_7.Vector)
cap_5 = CapHoles(Brep=extr_7)
cap_6 = CapHoles(Brep=extr_6)
cap_7 = CapHoles(Brep=extr_8)
cap_8 = CapHoles(Brep=extr_5)

# ----
# This group creates the side walls and the remaining pieces of the front of the
# instrument. The python block takes a curve the end points of the inner curves
# and the width of the instrument. It creates a line from the end points of the inner curves
# on the same side to create a line to loft to for the front face. It scales the line by
# calculating the distance between the end points and dividing that by the length of the
# given curve. for the other side of the instrument it mirrors the curve and
# performs the same steps on this mirrored curve. The left and right outputs are lists of
# 2 curves at different heights one on the plane and the other at the width. An offset
# is made of the curve and lofted between the curves on the same plane and then
# lofted between these 2d surfaces at different heights to create a closed brep.
# The created line and the bottom curve are lofted and then extruded and capped to
# create the closed brep.
geo_5 = Geometry(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)
geo_6 = Geometry(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)
python_5 = GhPythonScript(end_points=python_4.end_points, b_curve=geo_4, width=number_slider_4)  # -> out, left, left_bot, line, right, line1, right_bot; inputs end_points: list of Point3d
# ---------- python_5: Python ----------
import rhinoscriptsyntax as rs
import math

left = []
left_bot = rs.CopyObject(b_curve)
point = rs.CreatePoint(end_points[1].X,end_points[1].Y,end_points[1].Z)
left_bot = rs.MoveObject(left_bot,point)
b_length = rs.CurveEndPoint(b_curve).Y
length = math.sqrt(math.pow(end_points[1].Y-end_points[0].Y,2))
b_scale = length/b_length
left_bot = rs.ScaleObject(left_bot,point,rs.CreatePoint(b_scale,b_scale,1))
line = rs.AddLine(end_points[1],end_points[0])
left_top = rs.CopyObject(left_bot)
left_bot2 = rs.CopyObject(left_bot)
left_bot = rs.JoinCurves([left_bot,line])
point = rs.CreatePoint(0,0,width)
left_top = rs.MoveObject(left_top,point)
left.append(left_top)
left.append(left_bot2)

right = []
right_bot = rs.CopyObject(b_curve)
start_point = rs.CreatePoint(0,0,0)
end_point = rs.CreatePoint(0,rs.CurveEndPoint(b_curve).Y,0)
right_bot = rs.MirrorObject(right_bot,start_point,end_point)
point = rs.CreatePoint(end_points[3].X,end_points[3].Y,end_points[3].Z)
right_bot = rs.MoveObject(right_bot,point)
b_length = rs.CurveEndPoint(b_curve).Y
length = math.sqrt(math.pow(end_points[2].Y-end_points[3].Y,2))
b_scale = length/b_length
right_bot = rs.ScaleObject(right_bot,point,rs.CreatePoint(b_scale,b_scale,1))
line1 = rs.AddLine(end_points[3],end_points[2])
right_top = rs.CopyObject(right_bot)
right_bot2 = right_bot
right_bot = rs.JoinCurves([right_bot,line1])
point = rs.CreatePoint(0,0,width)
right_top = rs.MoveObject(right_top,point)
right.append(right_top)
right.append(right_bot2)
# ---------- end python_5 ----------
number_slider_11 = Slider(2, range=-10..10)
item_4 = ListItem(List=python_5.right, Index=0, Wrap=True)
item_5 = ListItem(List=python_5.right, Index=1, Wrap=True)
item_6 = ListItem(List=python_5.left, Index=1, Wrap=True)
item_7 = ListItem(List=python_5.left, Index=0, Wrap=True)
boundary_4 = BoundarySurfaces(Edges=python_5.right_bot)
number_slider_12 = Slider(2, range=-10..10)
boundary_5 = BoundarySurfaces(Edges=python_5.left_bot)
offset = OffsetCurve(Curve=item_4, Distance=number_slider_11, Corners=1)  # -> flatten(Curve)
offset_2 = OffsetCurve(Curve=item_5, Distance=number_slider_11, Corners=1)  # -> flatten(Curve)
offset_3 = OffsetCurve(Curve=item_7, Distance=number_slider_12, Corners=1)  # -> flatten(Curve)
offset_4 = OffsetCurve(Curve=item_6, Distance=number_slider_12, Corners=1)  # -> flatten(Curve)
merge = Merge(Data1=item_4, Data2=offset)  # -> flatten(Result)
merge_2 = Merge(Data1=item_5, Data2=offset_2)  # -> flatten(Result)
merge_3 = Merge(Data1=item_6, Data2=offset_4)  # -> flatten(Result)
merge_4 = Merge(Data1=item_7, Data2=offset_3)  # -> flatten(Result)
loft_5 = Loft(Curves=merge, Options={Adjust=False, Closed=False, LoftEnds=0, LoftSimp=0, LoftType=0, Rebuild=10, Refit=0.01})
vec_9 = VectorXYZ(XComponent=0, YComponent=0, ZComponent=Slider(2, range=-10..10))  # -> Vector, Length
loft_6 = Loft(Curves=merge_3, Options={Adjust=False, Closed=False, LoftEnds=0, LoftSimp=0, LoftType=0, Rebuild=10, Refit=0.01})
vec_10 = VectorXYZ(XComponent=0, YComponent=0, ZComponent=Slider(2, range=-10..10))  # -> Vector, Length
loft_7 = Loft(Curves=merge_2, Options={Adjust=False, Closed=False, LoftEnds=0, LoftSimp=0, LoftType=0, Rebuild=10, Refit=0.01})
loft_8 = Loft(Curves=merge_4, Options={Adjust=False, Closed=False, LoftEnds=0, LoftSimp=0, LoftType=0, Rebuild=10, Refit=0.01})
extr_9 = Extrude(Base=boundary_5, Direction=vec_9.Vector)
merge_5 = Merge(Data1=loft_8, Data2=loft_6)
extr_10 = Extrude(Base=boundary_4, Direction=vec_10.Vector)
merge_6 = Merge(Data1=loft_5, Data2=loft_7)
cap_9 = CapHoles(Brep=extr_9)
loft_9 = Loft(Curves=merge_5, Options={Adjust=False, Closed=False, LoftEnds=0, LoftSimp=0, LoftType=0, Rebuild=10, Refit=0.01})
loft_10 = Loft(Curves=merge_6, Options={Adjust=False, Closed=False, LoftEnds=0, LoftSimp=0, LoftType=0, Rebuild=10, Refit=0.01})
cap_10 = CapHoles(Brep=extr_10)
cap_11 = CapHoles(Brep=loft_9)
cap_12 = CapHoles(Brep=loft_10)

# ----
# This group lofts between the curves at the
# top and the bottom of the instrument that
# were created in the above group for the
# front of the instrument. The 2d surfaces
# created are extruded in the z direction and
# capped to created closed breps.
number_slider_13 = Slider(0, range=0..1)
item_8 = ListItem(List=python_4.t_l, Index=Slider(0, range=0..10), Wrap=True)
item_9 = ListItem(List=python_4.b_l, Index=number_slider_13, Wrap=True)
item_10 = ListItem(List=python_4.t_r, Index=Slider(0, range=0..10), Wrap=True)
item_11 = ListItem(List=python_4.b_r, Index=number_slider_13, Wrap=True)
merge_7 = Merge(Data1=item_8, Data2=item_9)
number_slider_14 = Slider(2, range=-10..10)
merge_8 = Merge(Data1=item_10, Data2=item_11)
loft_11 = Loft(Curves=merge_7, Options={Adjust=False, Closed=False, LoftEnds=0, LoftSimp=0, LoftType=0, Rebuild=10, Refit=0.01})
loft_12 = Loft(Curves=merge_8, Options={Adjust=False, Closed=False, LoftEnds=0, LoftSimp=0, LoftType=0, Rebuild=10, Refit=0.01})
vec_11 = VectorXYZ(XComponent=0, YComponent=0, ZComponent=number_slider_14)  # -> Vector, Length
vec_12 = VectorXYZ(XComponent=0, YComponent=0, ZComponent=number_slider_14)  # -> Vector, Length
extr_11 = Extrude(Base=loft_12, Direction=vec_11.Vector)
extr_12 = Extrude(Base=loft_11, Direction=vec_12.Vector)
cap_13 = CapHoles(Brep=extr_11)
cap_14 = CapHoles(Brep=extr_12)

# ----
# This group combines the 3 inner sections
# of the face of the instrument and takes the
# circle from the section.
merge_9 = Merge(Data1=cap_13, Data2=cap_14, Data3=cap_2)  # -> flatten(Result)
# Final Project: Ukulele
# Name: Michel Robert, Daniel  Morales-Garcia
# E-mail: Mrobert12@unm.edu, dmorales33@unm.edu
# Course: CS491, Computational Fabrication
# Submitted: 12/8/2023
# 
# This program creates the body of a ukulele from 2 lines
# created in rhino. The body is separated into top/walls
# and back. Each part of the body is separated into groups
# and described in those groups.
sunion = SolidUnion(Breps=merge_9)
sdiff = SolidDifference(BrepsA=sunion, BrepsB=cap)

panel = Panel(merge_6)

# ----
# This group creates the back of the
# instrument by taking all the components of
# the front without the circle cut out and joins
# them.
vec_13 = VectorXYZ(XComponent=0, YComponent=0, ZComponent=number_slider_5)  # -> Vector, Length
extr_13 = Extrude(Base=boundary, Direction=vec_13.Vector)
cap_15 = CapHoles(Brep=extr_13)
merge_10 = Merge(Data1=cap_15, Data2=cap_14, Data3=cap_13, Data4=cap_9, Data5=cap_10)  # -> flatten(Result)
sunion_2 = SolidUnion(Breps=merge_10)

# ----
# This group combines all the closed breps
# into a single object.
merge_11 = Merge(
    Data1=cap_4,
    Data2=cap_3,
    Data3=sdiff,
    Data4=cap_7,
    Data5=cap_5,
    Data6=cap_6,
    Data7=cap_8,
    Data8=cap_9,
    Data9=cap_11,
    Data10=cap_10,
    Data11=cap_12)  # -> flatten(Result)
sunion_3 = SolidUnion(Breps=merge_11)
panel_2 = Panel(sunion_3)
