# Grasshopper definition uke-2.gh (Grasshopper 1.0.7)

number_slider = Slider(100, range=0..100)
number_slider_2 = Slider(20, range=0..100)
geo = Geometry(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)
geo_2 = Geometry(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)
python = GhPythonScript(
    length=number_slider_2,
    height=number_slider,
    width=Slider(20, range=0..100),
    a_curve=geo,
    b_curve=geo_2,
    b_length=Slider(12, range=0..100))  # -> out, body, top_body
# ---------- python: Python ----------
import rhinoscriptsyntax as rs
import math

body = []
rect = []
orgin = rs.CreatePoint(0,0,0)
rect.append(rs.CreatePoint(0,0,0))
rect.append(rs.CreatePoint(length,0,0))
rect.append(rs.CreatePoint(length,height,0))
rect.append(rs.CreatePoint(0,height,0))
body.append(rs.AddLine(rect[0],rect[1]))
body.append(rs.AddLine(rect[2],rect[3]))

b_scale = b_length/rs.CurveEndPoint(b_curve).X
top_left = rs.CopyObject(b_curve)
top_left = rs.MirrorObject(top_left,[0,-50,0],[0,50,0],False)
top_left = rs.ScaleObject(top_left,orgin,rs.CreatePoint(b_scale,b_scale,1))
top_left = rs.MoveObject(top_left,rect[3])
body.append(top_left)
bot_left = rs.CopyObject(b_curve)
bot_left = rs.MirrorObject(bot_left,[0,-50,0],[0,50,0],False)
bot_left = rs.ScaleObject(bot_left,orgin,rs.CreatePoint(b_scale,b_scale,1))
bot_left = rs.MoveObject(bot_left,rect[0])
body.append(bot_left)
bot_right = rs.CopyObject(b_curve)
bot_right = rs.ScaleObject(bot_right,orgin,rs.CreatePoint(b_scale,b_scale,1))
bot_right = rs.MoveObject(bot_right,rect[1])
body.append(bot_right)
top_right = rs.CopyObject(b_curve)
top_right = rs.ScaleObject(top_right,orgin,rs.CreatePoint(b_scale,b_scale,1))
top_right = rs.MoveObject(top_right,rect[2])
body.append(top_right)

left = rs.CopyObject(a_curve)
length = math.sqrt(math.pow(rs.CurveEndPoint(bot_left).Y - rs.CurveEndPoint(top_left).Y,2))
a_scale = length/rs.CurveEndPoint(a_curve).Y
left = rs.ScaleObject(left,orgin,rs.CreatePoint(a_scale,a_scale,1))
left = rs.MoveObject(left,rs.CurveEndPoint(bot_left))
body.append(left)

right = rs.CopyObject(a_curve)
right = rs.ScaleObject(right,orgin,rs.CreatePoint(a_scale,a_scale,1))
right = rs.MirrorObject(right,[0,-1000,0],[0,1000,0],False)
right = rs.MoveObject(right,rs.CurveEndPoint(bot_right))
body.append(right)

body = rs.JoinCurves(body)

top_body = rs.CopyObject(body)
top_body = rs.MoveObject(top_body,[0,0,width])
# ---------- end python ----------
boundary = BoundarySurfaces(Edges=python.top_body)
boundary_2 = BoundarySurfaces(Edges=python.body)
panel = Panel(python.body)
python_2 = GhPythonScript(radius=Slider(13, range=0..25), height=number_slider, length=number_slider_2, y=Slider(0.7, range=0..1))  # -> out, circle
# ---------- python_2: Python ----------
import rhinoscriptsyntax as rs

center = rs.CreatePoint(length/2,height*y,0)
circle = rs.AddCircle(center,radius)
# ---------- end python_2 ----------
sdiff = SolidDifference(BrepsA=boundary_2, BrepsB=python_2.circle)
vec = VectorXYZ(XComponent=0, YComponent=0, ZComponent=Slider(-2, range=-10..10))  # -> Vector, Length
vec_2 = VectorXYZ(XComponent=0, YComponent=0, ZComponent=Slider(2, range=-10..10))  # -> Vector, Length
extr = Extrude(Base=sdiff, Direction=vec.Vector)
extr_2 = Extrude(Base=boundary, Direction=vec_2.Vector)
cap = CapHoles(Brep=extr)
cap_2 = CapHoles(Brep=extr_2)
