# Grasshopper definition ukulele [Nov-26 '23, 1524].gh (Grasshopper 1.0.7)

number_slider = Slider(40, range=0..100)
number_slider_2 = Slider(11, range=0..100)
number_slider_3 = Slider(18, range=0..100)
python = GhPythonScript(height=number_slider, width=number_slider_2, length=number_slider_3)  # -> out, lines
# ---------- python: Python ----------
import rhinoscriptsyntax as rs

points = []
lines = []

line1 = rs.AddLine(rs.CreatePoint(0,0,0),rs.CreatePoint(0,width,0))
lines.append(line1)

line2 = rs.AddLine(rs.CreatePoint(0,width,0),rs.CreatePoint(length,width,0))
lines.append(line2)

line3 = rs.AddLine(rs.CreatePoint(length,width,0),rs.CreatePoint(length,0,0))
line4 = rs.AddLine(rs.CreatePoint(length,0,0),rs.CreatePoint(0,0,0))
lines.append(line3)
lines.append(line4)

lines = rs.JoinCurves(lines)
# ---------- end python ----------
python_2 = GhPythonScript(height=number_slider, width=number_slider_2, length=number_slider_3)  # -> out, lines
# ---------- python_2: Python ----------
import rhinoscriptsyntax as rs

points = []
lines = []

line1 = rs.AddLine(rs.CreatePoint(0,width,0),rs.CreatePoint(length,width,0))
lines.append(line1)

line2 = rs.AddLine(rs.CreatePoint(0,width,height),rs.CreatePoint(length,width,height))
lines.append(line2)

line3 = rs.AddLine(rs.CreatePoint(0,width,0),rs.CreatePoint(0,width,height))
line4 = rs.AddLine(rs.CreatePoint(length,width,height),rs.CreatePoint(length,width,0))
lines.append(line3)
lines.append(line4)

lines = rs.JoinCurves(lines)
# ---------- end python_2 ----------
python_3 = GhPythonScript(height=number_slider, width=number_slider_2, length=number_slider_3)  # -> out, line1, line2
# ---------- python_3: Python ----------
import rhinoscriptsyntax as rs

points = []
lines = []

line1 = rs.AddLine(rs.CreatePoint(0,0,0),rs.CreatePoint(length,0,0))
lines.append(line1)

line2 = rs.AddLine(rs.CreatePoint(0,0,height),rs.CreatePoint(length,0,height))
lines.append(line2)



lines = rs.JoinCurves(lines)
# ---------- end python_3 ----------
radius = GhPythonScript(radius=Slider(5, range=0..10), height=number_slider, length=number_slider_3)  # -> out, circle
# ---------- radius: Python ----------
import rhinoscriptsyntax as rs

center = rs.CreatePoint(length/2,0,height/2)
circle = rs.AddCircle(center,radius)
circle = rs.RotateObject(circle,center,90,[1,0,0],False)
# ---------- end radius ----------
boundary = BoundarySurfaces(Edges=python.lines)
boundary_2 = BoundarySurfaces(Edges=python_2.lines)
merge = Merge(Data1=python_3.line1, Data2=python_3.line2)
item = ListItem(List=boundary, Index=Slider(0, range=0..2), Wrap=True)
item_2 = ListItem(List=boundary_2, Index=Slider(0, range=0..2), Wrap=True)
vec = VectorXYZ(XComponent=0, YComponent=Slider(-1, range=-10..10), ZComponent=0)  # -> Vector, Length
vec_2 = VectorXYZ(XComponent=0, YComponent=0, ZComponent=Slider(-2, range=-10..10))  # -> Vector, Length
loft = Loft(Curves=merge, Options={Adjust=False, Closed=False, LoftEnds=0, LoftSimp=0, LoftType=0, Rebuild=10, Refit=0.01})
sint = SolidIntersection(BrepsA=loft, BrepsB=radius.circle)
extr = Extrude(Base=item_2, Direction=vec.Vector)
extr_2 = Extrude(Base=item, Direction=vec_2.Vector)
cap = CapHoles(Brep=extr)
cap_2 = CapHoles(Brep=extr_2)
panel = Panel(cap)
item_3 = ListItem(List=sint, Index=Slider(0, range=0..2), Wrap=True)
vec_3 = VectorXYZ(XComponent=0, YComponent=Slider(1, range=-10..10), ZComponent=0)  # -> Vector, Length
extr_3 = Extrude(Base=item_3, Direction=vec_3.Vector)
cap_3 = CapHoles(Brep=extr_3)
merge_2 = Merge(Data1=cap_2, Data2=cap, Data3=cap_3)  # -> flatten(Result)
sunion = SolidUnion(Breps=merge_2)
panel_2 = Panel(sunion)
