# Grasshopper definition ukulele.gh (Grasshopper 1.0.7)

number_slider = Slider(92, range=0..100)
number_slider_2 = Slider(23, range=0..100)
number_slider_3 = Slider(16, range=0..100)

# ----
# This group creates the front rectangle of
# the body of the instrument
number_slider_4 = Slider(1, range=-10..10)
python = GhPythonScript(height=number_slider, width=number_slider_2, length=number_slider_3)  # -> out, lines, points
# ---------- python: Python ----------
import rhinoscriptsyntax as rs

points = []
lines = []
point1 = rs.CreatePoint(0,0,0)
point2 = rs.CreatePoint(length,0,0)
point3 = rs.CreatePoint(length,height,0)
point4 = rs.CreatePoint(0,height,0)
points.append(point1)
points.append(point2)
points.append(point3)
points.append(point4)
line1 = rs.AddLine(rs.CreatePoint(0,0,0),rs.CreatePoint(length,0,0))
line2 = rs.AddLine(rs.CreatePoint(0,height,0),rs.CreatePoint(length,height,0))
line3 = rs.AddLine(rs.CreatePoint(0,0,0),rs.CreatePoint(0,height,0))
line4 = rs.AddLine(rs.CreatePoint(length,height,0),rs.CreatePoint(length,0,0))

lines.append(line1)
lines.append(line2)
lines.append(line3)
lines.append(line4)
lines = rs.JoinCurves(lines)
# ---------- end python ----------
python_2 = GhPythonScript(radius=Slider(7, range=0..10), height=number_slider, length=number_slider_3)  # -> out, circle
# ---------- python_2: Python ----------
import rhinoscriptsyntax as rs

center = rs.CreatePoint(length/2,height/2,0)
circle = rs.AddCircle(center,radius)
# ---------- end python_2 ----------
boundary = BoundarySurfaces(Edges=python.lines)
sint = SolidIntersection(BrepsA=boundary, BrepsB=python_2.circle)

geo = Geometry(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)
geo_2 = Geometry(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)
geo_3 = Geometry(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)
geo_4 = Geometry(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)
number_slider_5 = Slider(0, range=0..1)

# ----
# This group creates the bottom of the
# rectangle of the body of the instrument
python_3 = GhPythonScript(height=number_slider, width=number_slider_2, length=number_slider_3)  # -> out, lines
# ---------- python_3: Python ----------
import rhinoscriptsyntax as rs

points = []
lines = []

line1 = rs.AddLine(rs.CreatePoint(0,0,0),rs.CreatePoint(0,0,width))
lines.append(line1)

line2 = rs.AddLine(rs.CreatePoint(0,0,width),rs.CreatePoint(length,0,width))
lines.append(line2)

line3 = rs.AddLine(rs.CreatePoint(length,0,width),rs.CreatePoint(length,0,0))
line4 = rs.AddLine(rs.CreatePoint(length,0,0),rs.CreatePoint(0,0,0))
lines.append(line3)
lines.append(line4)

lines = rs.JoinCurves(lines)
# ---------- end python_3 ----------
boundary_2 = BoundarySurfaces(Edges=python_3.lines)
number_slider_6 = Slider(-2, range=-10..10)
vec = VectorXYZ(XComponent=0, YComponent=number_slider_6, ZComponent=0)  # -> Vector, Length
extr = Extrude(Base=boundary_2, Direction=vec.Vector)
cap = CapHoles(Brep=extr)

# ----
# This group creates the top of the rectangle
#  of the body of the instrument
python_4 = GhPythonScript(height=number_slider, width=number_slider_2, length=number_slider_3)  # -> out, lines
# ---------- python_4: Python ----------
import rhinoscriptsyntax as rs

points = []
lines = []

line1 = rs.AddLine(rs.CreatePoint(0,height,0),rs.CreatePoint(0,height,width))
lines.append(line1)

line2 = rs.AddLine(rs.CreatePoint(0,height,width),rs.CreatePoint(length,height,width))
lines.append(line2)

line3 = rs.AddLine(rs.CreatePoint(0,height,0),rs.CreatePoint(length,height,0))
line4 = rs.AddLine(rs.CreatePoint(length,height,width),rs.CreatePoint(length,height,0))
lines.append(line3)
lines.append(line4)

lines = rs.JoinCurves(lines)
# ---------- end python_4 ----------
boundary_3 = BoundarySurfaces(Edges=python_4.lines)
number_slider_7 = Slider(2, range=-10..10)
vec_2 = VectorXYZ(XComponent=0, YComponent=number_slider_7, ZComponent=0)  # -> Vector, Length
extr_2 = Extrude(Base=boundary_3, Direction=vec_2.Vector)
cap_2 = CapHoles(Brep=extr_2)

python_5 = GhPythonScript(
    a_length=Slider(18, range=0..100),
    b_length=number_slider,
    a_curve=geo_4,
    width=number_slider_2,
    rectangle_points=python.points,
    z=number_slider_4,
    offset1=number_slider_7,
    offset2=number_slider_6)  # -> out, t_l, b_l, t_r, b_r, end_points; inputs rectangle_points: list of Point3d
# ---------- python_5: Python ----------
import rhinoscriptsyntax as rs

t_l = []
b_l = []
t_r = []
b_r = []
end_points = []
top_left = rs.CopyObject(a_curve)
point = rs.CreatePoint(rectangle_points[3].X,rectangle_points[3].Y+offset1,rectangle_points[3].Z + z)
top_left = rs.MoveObject(top_left,point)
top_left = rs.RotateObject(top_left,point,180)
a_curve_length = rs.CurveEndPoint(a_curve).X
a_scale = a_length/a_curve_length
top_left_b = rs.ScaleObject(top_left,point,rs.CreatePoint(a_scale,a_scale,1))
top_left_t = rs.CopyObject(top_left_b)
point = rs.CreatePoint(0,0,width-z)
top_left_t = rs.MoveObject(top_left_t,point)
t_l.append(top_left_b)
t_l.append(top_left_t)
end_point = rs.CurveEndPoint(top_left_b)
end_points.append(end_point)
bot_left = rs.CopyObject(a_curve)
point = rs.CreatePoint(rectangle_points[0].X,rectangle_points[0].Y+offset2,rectangle_points[0].Z + z)
bot_left = rs.MoveObject(bot_left,point)
bot_left = rs.RotateObject(bot_left,point,180)
a_curve_length = rs.CurveEndPoint(a_curve).X
a_scale = a_length/a_curve_length
bot_left_b = rs.ScaleObject(bot_left,point,rs.CreatePoint(a_scale,a_scale,1))
bot_left_t = rs.CopyObject(bot_left_b)
point = rs.CreatePoint(0,0,width-z)
bot_left_t = rs.MoveObject(bot_left_t,point)
end_point = rs.CurveEndPoint(bot_left_b)
end_points.append(end_point)
b_l.append(bot_left_b)
b_l.append(bot_left_t)

top_right = rs.CopyObject(a_curve)
point = rs.CreatePoint(rectangle_points[2].X,rectangle_points[2].Y+offset1,rectangle_points[2].Z + z)
top_right = rs.MoveObject(top_right,point)
a_curve_length = rs.CurveEndPoint(a_curve).X
a_scale = a_length/a_curve_length
top_right_b = rs.ScaleObject(top_right,point,rs.CreatePoint(a_scale,a_scale,1))
top_right_t = rs.CopyObject(top_right_b)
point = rs.CreatePoint(0,0,width-z)
top_right_t = rs.MoveObject(top_right_t,point)
end_point = rs.CurveEndPoint(top_right_b)
end_points.append(end_point)
t_r.append(top_right_b)
t_r.append(top_right_t)

bot_right = rs.CopyObject(a_curve)
point = rs.CreatePoint(rectangle_points[1].X,rectangle_points[1].Y+offset2,rectangle_points[1].Z + z)
bot_right = rs.MoveObject(bot_right,point)
a_curve_length = rs.CurveEndPoint(a_curve).X
a_scale = a_length/a_curve_length
bot_right_b = rs.ScaleObject(bot_right,point,rs.CreatePoint(a_scale,a_scale,1))
bot_right_t = rs.CopyObject(bot_right_b)
point = rs.CreatePoint(0,0,width-z)
bot_right_t = rs.MoveObject(bot_right_t,point)
end_point = rs.CurveEndPoint(bot_right_b)
end_points.append(end_point)
b_r.append(bot_right_b)
b_r.append(bot_right_t)
# ---------- end python_5 ----------
python_6 = GhPythonScript(end_points=python_5.end_points, b_curve=geo_3, width=number_slider_2, z=number_slider_4)  # -> out, right, line; inputs end_points: list of Point3d
# ---------- python_6: Python ----------
import rhinoscriptsyntax as rs
import math

right = []
right_bot = rs.CopyObject(b_curve)
start_point = rs.CreatePoint(0,0,0)
end_point = rs.CreatePoint(0,rs.CurveEndPoint(b_curve).Y,0)
right_bot = rs.MirrorObject(right_bot,start_point,end_point)
point = rs.CreatePoint(end_points[3].X,end_points[3].Y,end_points[3].Z)
right_bot = rs.MoveObject(right_bot,point)
b_length = rs.CurveEndPoint(b_curve).Y
length = math.sqrt(math.pow(end_points[2].Y-end_points[3].Y,2))
b_scale = length/b_length
right_bot = rs.ScaleObject(right_bot,point,rs.CreatePoint(b_scale,b_scale,1))
line = rs.AddLine(end_points[3],end_points[2])
right_top = rs.CopyObject(right_bot)
point = rs.CreatePoint(0,0,width-z)
right_top = rs.MoveObject(right_top,point)
right.append(right_top)
right.append(right_bot)
# ---------- end python_6 ----------
python_7 = GhPythonScript(end_points=python_5.end_points, b_curve=geo_3, width=number_slider_2, z=number_slider_4)  # -> out, left, line; inputs end_points: list of Point3d
# ---------- python_7: Python ----------
import rhinoscriptsyntax as rs
import math

left = []
left_bot = rs.CopyObject(b_curve)
point = rs.CreatePoint(end_points[1].X,end_points[1].Y,end_points[1].Z)
left_bot = rs.MoveObject(left_bot,point)
b_length = rs.CurveEndPoint(b_curve).Y
length = math.sqrt(math.pow(end_points[1].Y-end_points[0].Y,2))
b_scale = length/b_length
left_bot = rs.ScaleObject(left_bot,point,rs.CreatePoint(b_scale,b_scale,1))
line = rs.AddLine(end_points[1],end_points[0])
left_top = rs.CopyObject(left_bot)
point = rs.CreatePoint(0,0,width-z)
left_top = rs.MoveObject(left_top,point)
left.append(left_top)
left.append(left_bot)
# ---------- end python_7 ----------
item = ListItem(List=python_5.t_l, Index=Slider(0, range=0..10), Wrap=True)
item_2 = ListItem(List=python_5.b_l, Index=number_slider_5, Wrap=True)
item_3 = ListItem(List=python_5.t_r, Index=Slider(0, range=0..10), Wrap=True)
item_4 = ListItem(List=python_5.b_r, Index=number_slider_5, Wrap=True)
item_5 = ListItem(List=python_7.left, Index=0, Wrap=True)
item_6 = ListItem(List=python_7.left, Index=1, Wrap=True)
item_7 = ListItem(List=python_7.left, Index=1, Wrap=True)
merge = Merge(Data1=item, Data2=item_2)
merge_2 = Merge(Data1=item_3, Data2=item_4)
loft = Loft(Curves=python_5.b_l, Options={Adjust=False, Closed=False, LoftEnds=0, LoftSimp=0, LoftType=0, Rebuild=10, Refit=0.01})
item_8 = ListItem(List=python_6.right, Index=0, Wrap=True)
item_9 = ListItem(List=python_6.right, Index=1, Wrap=True)
loft_2 = Loft(Curves=python_5.b_r, Options={Adjust=False, Closed=False, LoftEnds=0, LoftSimp=0, LoftType=0, Rebuild=10, Refit=0.01})
item_10 = ListItem(List=python_6.right, Index=1, Wrap=True)
merge_3 = Merge(Data1=item_7, Data2=python_7.line)  # -> flatten(Result)
loft_3 = Loft(Curves=python_5.t_l, Options={Adjust=False, Closed=False, LoftEnds=0, LoftSimp=0, LoftType=0, Rebuild=10, Refit=0.01})
loft_4 = Loft(Curves=python_5.t_r, Options={Adjust=False, Closed=False, LoftEnds=0, LoftSimp=0, LoftType=0, Rebuild=10, Refit=0.01})
loft_5 = Loft(Curves=merge, Options={Adjust=False, Closed=False, LoftEnds=0, LoftSimp=0, LoftType=0, Rebuild=10, Refit=0.01})
loft_6 = Loft(Curves=merge_2, Options={Adjust=False, Closed=False, LoftEnds=0, LoftSimp=0, LoftType=0, Rebuild=10, Refit=0.01})
loft_7 = Loft(Curves=merge_3, Options={Adjust=False, Closed=False, LoftEnds=0, LoftSimp=0, LoftType=0, Rebuild=10, Refit=0.01})
merge_4 = Merge(Data1=item_10, Data2=python_6.line)  # -> flatten(Result)
item_11 = ListItem(List=loft, Index=0, Wrap=True)

vec_3 = VectorXYZ(XComponent=0, YComponent=0, ZComponent=number_slider_4)  # -> Vector, Length
extr_3 = Extrude(Base=sint, Direction=vec_3.Vector)
cap_3 = CapHoles(Brep=extr_3)

offset = OffsetCurve(Curve=item_5, Distance=Slider(-2, range=-10..10), Corners=1)  # -> flatten(Curve)
offset_2 = OffsetCurve(Curve=item_6, Distance=Slider(-2, range=-10..10), Corners=1)  # -> flatten(Curve)
item_12 = ListItem(List=loft_3, Index=0, Wrap=True)
vec_4 = VectorXYZ(XComponent=0, YComponent=Slider(2, range=-10..10), ZComponent=0)  # -> Vector, Length
item_13 = ListItem(List=loft_4, Index=0, Wrap=True)
vec_5 = VectorXYZ(XComponent=0, YComponent=Slider(2, range=-10..10), ZComponent=0)  # -> Vector, Length
vec_6 = VectorXYZ(XComponent=0, YComponent=Slider(-2, range=-10..10), ZComponent=0)  # -> Vector, Length
vec_7 = VectorXYZ(XComponent=0, YComponent=Slider(-2, range=-10..10), ZComponent=0)  # -> Vector, Length
vec_8 = VectorXYZ(XComponent=0, YComponent=0, ZComponent=Slider(-1, range=-10..10))  # -> Vector, Length
offset_3 = OffsetCurve(Curve=item_8, Distance=Slider(-2, range=-10..10), Corners=1)  # -> flatten(Curve)
extr_4 = Extrude(Base=item_11, Direction=vec_4.Vector)
offset_4 = OffsetCurve(Curve=item_9, Distance=Slider(-2, range=-10..10), Corners=1)  # -> flatten(Curve)
loft_8 = Loft(Curves=merge_4, Options={Adjust=False, Closed=False, LoftEnds=0, LoftSimp=0, LoftType=0, Rebuild=10, Refit=0.01})
extr_5 = Extrude(Base=loft_2, Direction=vec_5.Vector)
vec_9 = VectorXYZ(XComponent=0, YComponent=0, ZComponent=Slider(-1, range=-10..10))  # -> Vector, Length
merge_5 = Merge(Data1=item_5, Data2=offset)  # -> flatten(Result)
extr_6 = Extrude(Base=item_12, Direction=vec_6.Vector)
extr_7 = Extrude(Base=item_13, Direction=vec_7.Vector)
merge_6 = Merge(Data1=item_6, Data2=offset_2)  # -> flatten(Result)
cap_4 = CapHoles(Brep=extr_4)
extr_8 = Extrude(Base=loft_5, Direction=vec_8.Vector)
cap_5 = CapHoles(Brep=extr_5)
extr_9 = Extrude(Base=loft_6, Direction=vec_9.Vector)
cap_6 = CapHoles(Brep=extr_6)
merge_7 = Merge(Data1=item_8, Data2=offset_3)  # -> flatten(Result)
cap_7 = CapHoles(Brep=extr_7)
loft_9 = Loft(Curves=merge_5, Options={Adjust=False, Closed=False, LoftEnds=0, LoftSimp=0, LoftType=0, Rebuild=10, Refit=0.01})
merge_8 = Merge(Data1=item_9, Data2=offset_4)  # -> flatten(Result)
cap_8 = CapHoles(Brep=extr_8)
cap_9 = CapHoles(Brep=extr_9)
vec_10 = VectorXYZ(XComponent=0, YComponent=0, ZComponent=Slider(-1, range=-10..10))  # -> Vector, Length
loft_10 = Loft(Curves=merge_6, Options={Adjust=False, Closed=False, LoftEnds=0, LoftSimp=0, LoftType=0, Rebuild=10, Refit=0.01})
loft_11 = Loft(Curves=merge_7, Options={Adjust=False, Closed=False, LoftEnds=0, LoftSimp=0, LoftType=0, Rebuild=10, Refit=0.01})
extr_10 = Extrude(Base=loft_7, Direction=vec_10.Vector)
vec_11 = VectorXYZ(XComponent=0, YComponent=0, ZComponent=Slider(-1, range=-10..10))  # -> Vector, Length
loft_12 = Loft(Curves=merge_8, Options={Adjust=False, Closed=False, LoftEnds=0, LoftSimp=0, LoftType=0, Rebuild=10, Refit=0.01})
merge_9 = Merge(Data1=loft_9, Data2=loft_10)
cap_10 = CapHoles(Brep=extr_10)
extr_11 = Extrude(Base=loft_8, Direction=vec_11.Vector)
merge_10 = Merge(Data1=loft_11, Data2=loft_12)
loft_13 = Loft(Curves=merge_9, Options={Adjust=False, Closed=False, LoftEnds=0, LoftSimp=0, LoftType=0, Rebuild=10, Refit=0.01})
cap_11 = CapHoles(Brep=extr_11)
loft_14 = Loft(Curves=merge_10, Options={Adjust=False, Closed=False, LoftEnds=0, LoftSimp=0, LoftType=0, Rebuild=10, Refit=0.01})
cap_12 = CapHoles(Brep=loft_13)
vec_12 = VectorXYZ(XComponent=0, YComponent=0, ZComponent=number_slider_4)  # -> Vector, Length
cap_13 = CapHoles(Brep=loft_14)
extr_12 = Extrude(Base=boundary, Direction=vec_12.Vector)
merge_11 = Merge(Data1=cap_11, Data2=cap_13)
merge_12 = Merge(
    Data1=cap,
    Data2=cap_2,
    Data3=cap_3,
    Data4=cap_6,
    Data5=cap_4,
    Data6=cap_7,
    Data7=cap_5,
    Data8=cap_8,
    Data9=cap_9,
    Data10=cap_10,
    Data11=cap_12,
    Data12=merge_11)  # -> flatten(Result)
sunion = SolidUnion(Breps=merge_12)
panel = Panel(sunion)
cap_14 = CapHoles(Brep=extr_12)
merge_13 = Merge(Data1=cap_14, Data2=cap_8, Data3=cap_9, Data4=cap_10, Data5=cap_11)  # -> flatten(Result)
sunion_2 = SolidUnion(Breps=merge_13)
